# Dynamo custom node Collector.FilterStringEquals.dyf (Dynamo 2.6.1.8786)
# category: MEPover.Revit.Parameters
# Returns the most common elements (host objects and family instances) by supplying a parameter and the value to search for. Of course the parameter needs to be of type 'string' to work.

SearchValue = Input(SearchValue: string)
parameter = Input(parameter: string)
code_block = CodeBlock { false; }
python_filterstringequals = Python(IN[0]=SearchValue, IN[1]=parameter, IN[2]=code_block)
# ---------- python_filterstringequals.python (110 lines) ----------
import clr
import System

clr.AddReference("RevitServices")
import RevitServices
from RevitServices.Persistence import DocumentManager
from RevitServices.Transactions import TransactionManager
doc = DocumentManager.Instance.CurrentDBDocument

clr.AddReference("RevitAPI")
import Autodesk
from Autodesk.Revit.DB import *

clr.AddReference("RevitNodes")
import Revit
clr.ImportExtensions(Revit.Elements)
clr.ImportExtensions(Revit.GeometryConversion)

from System.Collections.Generic import List
string = IN[0]
case = IN[2]
search = IN[1]

bips = System.Enum.GetValues(BuiltInParameter)

bm = doc.ParameterBindings
bmlist = bm.ForwardIterator()
paramId = None
testout = []
while bmlist.MoveNext():
	binddef = bmlist.Key
	testout.append(binddef.Name)
	if binddef.Name == search:
		paramId = binddef.Id
		break

param = None
if paramId == None:
	biplist = []
	for bip in bips:
		try:
			name = LabelUtils.GetLabelFor(bip)
		except:
			continue
		if name == search:
			biplist.append(bip)


sharedparamrule = SharedParameterApplicableRule(search)
evaluator = FilterStringEquals()

parameter = None
if paramId == None and len(biplist) == 0:
	coll = FilteredElementCollector(doc)
	sharedparams = coll.OfClass(ParameterElement)
	
	for param in sharedparams:
		name = param.GetDefinition().Name
		if name == search:
			parameter = param
	
	if parameter != None:
		ruleslist = List[FilterRule]()
		provider = ParameterValueProvider(parameter.Id)
		filterrule = FilterStringRule(provider, evaluator, string, case)
		ruleslist.Add(filterrule)
		ruleslist.Add(sharedparamrule)
		paramFilter = ElementParameterFilter(ruleslist)
		collector = FilteredElementCollector(doc)
		collector.OfClass(FamilyInstance).WherePasses(paramFilter)
		
		collector2 = FilteredElementCollector(doc)
		collector2.OfClass(HostObject).WherePasses(paramFilter)
		collector2.UnionWith(collector)

elif paramId == None:
	filterList = List[ElementFilter]()
	for param in biplist:
		provider = ParameterValueProvider(ElementId(param))
		filterrule = FilterStringRule(provider, evaluator, string, case)
		paramFilter = ElementParameterFilter(filterrule)
		filterList.Add(paramFilter)
			
	orFilter = LogicalOrFilter(filterList)
	collector = FilteredElementCollector(doc)
	collector.OfClass(FamilyInstance).WherePasses(orFilter)
	
	collector2 = FilteredElementCollector(doc)
	collector2.OfClass(HostObject).WherePasses(orFilter)
	collector2.UnionWith(collector)
else:
	ruleslist = List[FilterRule]()
	provider = ParameterValueProvider(paramId)
	filterrule = FilterStringRule(provider, evaluator, string, case)
	ruleslist.Add(filterrule)
	ruleslist.Add(sharedparamrule)
	paramFilter = ElementParameterFilter(ruleslist)
	collector = FilteredElementCollector(doc)
	collector.OfClass(FamilyInstance).WherePasses(paramFilter)
	
	collector2 = FilteredElementCollector(doc)
	collector2.OfClass(HostObject).WherePasses(paramFilter)
	collector2.UnionWith(collector)


if parameter == None and paramId == None and len(biplist) == 0:
	OUT = "Does not work with non-shared family parameters"
else:
	elements = collector2.ToElements()
	OUT = elements
# ----------------------------------------
Elements = Output(python_filterstringequals)
