# Dynamo custom node Connector.Direction_BasisX.dyf (Dynamo 2.6.1.8786)
# category: MEPover.Revit.Connectors
# Returns the direction (X value) of the CoordinateSystem of the Connector

connector = Input(connector: var[]..[])
python_script = Python(IN[0]=connector)
# ---------- python_script.python (41 lines) ----------
import clr

clr.AddReference("RevitServices")
import RevitServices
from RevitServices.Persistence import DocumentManager
from RevitServices.Transactions import TransactionManager
doc = DocumentManager.Instance.CurrentDBDocument

clr.AddReference("RevitAPI")
import Autodesk
from Autodesk.Revit.DB import *

clr.AddReference("RevitNodes")
import Revit
clr.ImportExtensions(Revit.Elements)
clr.ImportExtensions(Revit.GeometryConversion)

#Many thanks to Konrad K Sobon for his awesome ProcessList function!
def Unwrap(item):
	return UnwrapElement(item)

def ProcessList(_func, _list):
    return map( lambda x: ProcessList(_func, x) if type(x)==list else _func(x), _list )

if isinstance(IN[0], list):
	connectors = ProcessList(Unwrap, IN[0])
else:
	connectors = [Unwrap(IN[0])]
	
	
def getConnDir(connector):
	try:
		return connector.CoordinateSystem.BasisX.ToVector()
	except:
		return None


			
#Assign your output to the OUT variable.

OUT = ProcessList(getConnDir, connectors)
# ----------------------------------------
Direction = Output(python_script)
