# Dynamo custom node Connector.DisconnectFrom.dyf (Dynamo 2.6.1.8786)
# category: MEPover.Revit.Connectors
# Disconnects a connector from another connector. Returns True if succeeded

connector = Input(connector: var[]..[])
Connector2 = Input(Connector2: var[]..[])
python = Python(IN[0]=connector, IN[1]=Connector2)
# ---------- python.python (52 lines) ----------
import clr

clr.AddReference("RevitServices")
import RevitServices
from RevitServices.Persistence import DocumentManager
from RevitServices.Transactions import TransactionManager
doc = DocumentManager.Instance.CurrentDBDocument

clr.AddReference("RevitAPI")
import Autodesk
from Autodesk.Revit.DB import *

clr.AddReference("RevitNodes")
import Revit
clr.ImportExtensions(Revit.Elements)
clr.ImportExtensions(Revit.GeometryConversion)

#Many thanks to Konrad K Sobon for his awesome ProcessList function!
def Unwrap(item):
	return UnwrapElement(item)
	
def ProcessList(_func, _list):
    return map( lambda x: ProcessList(_func, x) if type(x)==list else _func(x), _list )

def ProcessList2(_func, _list, _list2):
    return map( lambda x,y: ProcessList2(_func, x, y) if type(x)==list else _func(x,y), _list, _list2 )

if isinstance(IN[0], list):
	connectors = IN[0]
else:
	connectors = [IN[0]]
	
if isinstance(IN[1], list):
	connectors2 = IN[1]
else:
	connectors2 = [IN[1]]
	
	
def DisconnectFrom(connector, conn2):
	bool = False
	try:
		TransactionManager.Instance.EnsureInTransaction(doc)
		connector.DisconnectFrom(conn2)
		bool = True
		TransactionManager.Instance.TransactionTaskDone()
	except:
		pass
	return bool

			
#Assign your output to the OUT variable.
OUT = ProcessList2(DisconnectFrom, connectors, connectors2)
# ----------------------------------------
Disconnected = Output(python)
