# Dynamo custom node Connector.RemoveFromSystem.dyf (Dynamo 2.0.3.8810)
# category: MEPover.Revit.Connectors
# Removes a connector from a Mechanical or Piping system

System = Input(System: var[]..[])
connector = Input(connector: var[]..[])
python_script = Python(IN[0]=System, IN[1]=connector)
# ---------- python_script.python (75 lines) ----------
import clr

clr.AddReference("RevitServices")
import RevitServices
from RevitServices.Persistence import DocumentManager
from RevitServices.Transactions import TransactionManager
doc = DocumentManager.Instance.CurrentDBDocument

clr.AddReference("RevitAPI")
import Autodesk
from Autodesk.Revit.DB import *

clr.AddReference("RevitNodes")
import Revit
clr.ImportExtensions(Revit.Elements)
clr.ImportExtensions(Revit.GeometryConversion)


def RemoveFromSystem(sys,connectors):
	result = []
	systype = sys.SystemType
	if systype.GetType() == Mechanical.DuctSystemType:
		TransactionManager.Instance.EnsureInTransaction(doc)
		if hasattr(connectors, "__iter__"):
			for connector in connectors:
				try:
					if connector.DuctSystemType == systype:
						connset = ConnectorSet()
						connset.Insert(connector)
						sys.Remove(connset)
						result.append(connector)
				except:
					pass
		else:
			try:
				if connectors.DuctSystemType == systype:
					connset = ConnectorSet()
					connset.Insert(connectors)
					sys.Remove(connset)
					result.append(connectors)
			except:
				pass
		TransactionManager.Instance.TransactionTaskDone()
	else:
		TransactionManager.Instance.EnsureInTransaction(doc)
		if hasattr(connectors, "__iter__"):
			for connector in connectors:
				try:
					if connector.PipeSystemType == systype:
						connset = ConnectorSet()
						connset.Insert(connector)
						sys.Remove(connset)
						result.append(connector)
				except:
					pass
		else:
			try:
				if connectors.PipeSystemType == systype:
					connset = ConnectorSet()
					connset.Insert(connectors)
					sys.Remove(connset)
					result.append(connectors)
			except:
				pass
		TransactionManager.Instance.TransactionTaskDone()
	return result

listout = []
if isinstance(IN[0], list):
	for i,sys in enumerate(UnwrapElement(IN[0])):
		listout.append(RemoveFromSystem(sys,UnwrapElement(IN[1])[i]))
else:
	listout.append(RemoveFromSystem(UnwrapElement(IN[0]),UnwrapElement(IN[1])))

OUT = listout
# ----------------------------------------
connector_2 = Output(python_script)  # "connector"
