# Dynamo custom node Duct or pipe systems all elements.dyf "Duct or pipe systems all terminal elements" (Dynamo 2.6.1.8786)
# category: MEPover.Revit.Systems
# Returns all the terminal elements in the provided systems

Systems = Input(Systems: var[]..[])
python_script = Python(IN[0]=Systems)
# ---------- python_script.python (38 lines) ----------
import clr
clr.AddReference('RevitAPI')
from Autodesk.Revit.DB import *

clr.AddReference("RevitNodes")
import Revit
clr.ImportExtensions(Revit.Elements)
clr.ImportExtensions(Revit.GeometryConversion)

clr.AddReference("RevitServices")
import RevitServices
from RevitServices.Persistence import DocumentManager
doc = DocumentManager.Instance.CurrentDBDocument

#All credit for the ProcessList function goes to Archi-lab author Konrad Sobon
def ProcessList(_func, _list):
    return map( lambda x: ProcessList(_func, x) if type(x)==list else _func(x), _list )

def Unwrap(e):
	return UnwrapElement(e)

	
if isinstance(IN[0], list):
	systems = ProcessList(Unwrap, IN[0])
	toggle = 0
else:
	systems = [Unwrap(IN[0])]
	toggle = 1
#The inputs to this node will be stored as a list in the IN variables.
def systemElements(systems):
	elements = systems.Elements
	sublist = []
	for x in elements:
		sublist.append(x)
	return sublist

result = ProcessList(systemElements,systems)
OUT = result
# ----------------------------------------
Elements = Output(python_script)
