# Dynamo custom node Duct_Downstream_Components.dyf (Dynamo 2.13.1.3887)
# category: MEPover.Revit.Systems
# Returns all connected elements down the duct network

DuctElement = Input(DuctElement: var[]..[])
python_script = Python(IN[0]=DuctElement)  # IronPython2
# ---------- python_script.python (105 lines) ----------
import clr

import sys
pyt_path = r'C:\Program Files (x86)\IronPython 2.7\Lib'
sys.path.append(pyt_path)
import System

clr.AddReference("RevitServices")
import RevitServices
from RevitServices.Persistence import DocumentManager
from RevitServices.Transactions import TransactionManager
doc = DocumentManager.Instance.CurrentDBDocument

clr.AddReference("RevitAPI")
import Autodesk
from Autodesk.Revit.DB import *

clr.AddReference("RevitNodes")
import Revit
clr.ImportExtensions(Revit.Elements)
clr.ImportExtensions(Revit.GeometryConversion)

import collections
#The inputs to this node will be stored as a list in the IN variables.
if isinstance(IN[0],list):
	connector = UnwrapElement(IN[0])
	toggle = 0
else:
	connector = [UnwrapElement(IN[0])]
	toggle = 1
	
		
def nextElements(elem):
	listout = []
	if elem.GetType() == Connector:
		conn = elem
		for c in conn.AllRefs:
			if c.Owner.Id.Equals(elem.Owner.Id):
				continue
			elif isinstance(c.Owner,MEPSystem):
				continue
			else:
				newelem = c.Owner
			listout.append(newelem)
		return listout
	try:
		connectors = elem.ConnectorManager.Connectors
	except:
		connectors = elem.MEPModel.ConnectorManager.Connectors
	for conn in connectors:
		for c in conn.AllRefs:
			if c.Domain == Domain.DomainUndefined:
				continue			
			if c.Owner.Id.Equals(elem.Id):
				continue
			elif isinstance(c.Owner,MEPSystem):
				continue
			elif c.Owner.Id.Equals(ownerId):
				continue
			elif c.Direction == direction:
				continue
			else:
				newelem = c.Owner
			listout.append(newelem)
	return listout

	
def collector(elem):
	cont = 0
	elements = nextElements(elem)
	for x in elements:
		if x.Id in lookup:
			cont += 1
		else:
			item = doc.GetElement(x.Id)

			lookup[x.Id] = item
			collector(x)
	if cont == len(elements):
		return elem
		

		

listout = []

for x in connector:
	lookup = collections.OrderedDict()
	if x.GetType() == Connector:
		ownerId = x.Owner.Id
	else:
		ownerId = x.Id
		sysname = x.get_Parameter(BuiltInParameter.RBS_SYSTEM_CLASSIFICATION_PARAM).AsString()
		if "Return Air" in sysname:
			direction = FlowDirectionType.In
		else:
			direction = FlowDirectionType.Out
	collector(x)
	listout.append(lookup.Values)

#Assign your output to the OUT variable.
if toggle:
	OUT = lookup.Values
else:
	OUT = listout
# ----------------------------------------
elements = Output(python_script)
