# Dynamo custom node ElectricalCircuit Get Panels and Elements.dyf (Dynamo 2.6.1.8786)
# category: MEPover.Revit.Systems
# Returns the Panels and Elements belonging to the given electrical circuits

Electrical_Circuits = Input(Electrical_Circuits: var[]..[])
python_script = Python(IN[0]=Electrical_Circuits)
# ---------- python_script.python (26 lines) ----------
import clr
clr.AddReference('ProtoGeometry')
from Autodesk.DesignScript.Geometry import *
#The inputs to this node will be stored as a list in the IN variables.
if isinstance(IN[0], list):
	systems = UnwrapElement(IN[0])
	toggle = 0
else:
	systems = [UnwrapElement(IN[0])]
	toggle = 1
panels = []
elements = []

for x in systems:
	panels.append(x.BaseEquipment)
	sublist = []
	elementset = x.Elements
	for x in elementset:
		sublist.append(x)
	elements.append(sublist)

#Assign your output to the OUT variable.
if toggle:
	OUT = panels[0], sublist
else:
	OUT = panels, elements
# ----------------------------------------
code_block = CodeBlock(x=python_script) { x[0]; }
Panels = Output(code_block)
code_block_2 = CodeBlock(x=python_script) { x[1]; }
Elements = Output(code_block_2)
