# Dynamo custom node ElectricalFitting connector count.dyf (Dynamo 2.6.1.8786)
# category: MEPover.Revit.Elements
# Returns the number of connectors on the cable tray or conduit fitting

Fittings = Input(Fittings: var[]..[])
python_script = Python(IN[0]=Fittings)
# ---------- python_script.python (16 lines) ----------
import clr
clr.AddReference('ProtoGeometry')
from Autodesk.DesignScript.Geometry import *
#The inputs to this node will be stored as a list in the IN variables.
if isinstance(IN[0], list):
	fittings = UnwrapElement(IN[0])
else:
	fittings = [UnwrapElement(IN[0])]
	
count = []

for x in fittings:
	count.append(x.MEPModel.ConnectorManager.Connectors.Size)

#Assign your output to the OUT variable.
OUT = count
# ----------------------------------------
Connector_Count = Output(python_script)
