# Dynamo custom node ElectricalSystem.AddToPanel.dyf (Dynamo 2.6.1.8786)
# category: MEPover.Revit.Systems
# Adds the circuits to the panel

panel = Input(panel: var[]..[])
Circuits = Input(Circuits: var[]..[])
python_addtopanel = Python(IN[0]=panel, IN[1]=Circuits)
# ---------- python_addtopanel.python (45 lines) ----------
import clr

clr.AddReference("RevitServices")
import RevitServices
from RevitServices.Persistence import DocumentManager
from RevitServices.Transactions import TransactionManager
doc = DocumentManager.Instance.CurrentDBDocument

clr.AddReference("RevitAPI")
import Autodesk
from Autodesk.Revit.DB import *

clr.AddReference("RevitNodes")
import Revit
clr.ImportExtensions(Revit.Elements)
clr.ImportExtensions(Revit.GeometryConversion)

succes = []
failed = []

def AddToPanel(panel,circuits):
	TransactionManager.Instance.EnsureInTransaction(doc)
	if hasattr(circuits, "__iter__"):
		for circuit in circuits:
			try:
				circuit.SelectPanel(panel)
				succes.append(circuit.ToDSType(True))
			except:
				failed.append(circuit.ToDSType(True))
	else:
		try:
			circuits.SelectPanel(panel)
			succes.append(circuits.ToDSType(True))
		except:
			failed.append(circuits.ToDSType(True))
	TransactionManager.Instance.TransactionTaskDone()
	

if isinstance(IN[0], list):
	for i,sys in enumerate(UnwrapElement(IN[0])):
		AddToPanel(sys,UnwrapElement(IN[1])[i])
else:
	AddToPanel(UnwrapElement(IN[0]),UnwrapElement(IN[1]))

OUT = succes, failed
# ----------------------------------------
code_block = CodeBlock(x=python_addtopanel) { x[0]; }
Success = Output(code_block)
code_block_2 = CodeBlock(x=python_addtopanel) { x[1]; }
Failed = Output(code_block_2)
