# Dynamo custom node ElectricalSystem.DisconnectPanel.dyf (Dynamo 2.6.1.8786)
# category: MEPover.Revit.Systems
# Disconnects the panel the circuit

Circuit = Input(Circuit: var[]..[])
python_disconnectpanel = Python(IN[0]=Circuit)
# ---------- python_disconnectpanel.python (42 lines) ----------
import clr

clr.AddReference("RevitServices")
import RevitServices
from RevitServices.Persistence import DocumentManager
from RevitServices.Transactions import TransactionManager
doc = DocumentManager.Instance.CurrentDBDocument

clr.AddReference("RevitAPI")
import Autodesk
from Autodesk.Revit.DB import *

clr.AddReference("RevitNodes")
import Revit
clr.ImportExtensions(Revit.Elements)
clr.ImportExtensions(Revit.GeometryConversion)

def RemovePanel(circuit):
	TransactionManager.Instance.EnsureInTransaction(doc)
	if hasattr(circuit, "__iter__"):
		succes = []
		failed = []
		for cir in circuit:
			try:
				cir.DisconnectPanel()
				succes.append(cir.ToDSType(True))
			except:
				failed.append(cir.ToDSType(True))
	else:
		succes = []
		failed = []
		try:
			circuit.DisconnectPanel()
			succes = circuit.ToDSType(True)
		except:
			failed = circuit.ToDSType(True)
	TransactionManager.Instance.TransactionTaskDone()
	return succes, failed



OUT = RemovePanel(UnwrapElement(IN[0]))
# ----------------------------------------
code_block = CodeBlock(x=python_disconnectpanel) { x[0]; }
Success = Output(code_block)
code_block_2 = CodeBlock(x=python_disconnectpanel) { x[1]; }
Failed = Output(code_block_2)
