# Dynamo custom node ElectricalSystem.RemoveFromCircuit.dyf (Dynamo 2.6.1.8786)
# category: MEPover.Revit.Systems
# Removes the elements from the circuit

Circuit = Input(Circuit: var[]..[])
Elements = Input(Elements: var[]..[])
python_script = Python(IN[0]=Circuit, IN[1]=Elements)
# ---------- python_script.python (49 lines) ----------
import clr

clr.AddReference("RevitServices")
import RevitServices
from RevitServices.Persistence import DocumentManager
from RevitServices.Transactions import TransactionManager
doc = DocumentManager.Instance.CurrentDBDocument

clr.AddReference("RevitAPI")
import Autodesk
from Autodesk.Revit.DB import *

clr.AddReference("RevitNodes")
import Revit
clr.ImportExtensions(Revit.Elements)
clr.ImportExtensions(Revit.GeometryConversion)

succes = []
failed = []

def RemoveFromCircuit(sys,elements):
	TransactionManager.Instance.EnsureInTransaction(doc)
	if hasattr(elements, "__iter__"):
		for element in elements:
			elemset = ElementSet()
			elemset.Insert(element)
			try:
				sys.RemoveFromCircuit(elemset)
				succes.append(element.ToDSType(True))
			except:
				failed.append(element.ToDSType(True))
	else:
		elemset = ElementSet()
		elemset.Insert(elements)
		try:
			sys.RemoveFromCircuit(elemset)
			succes.append(elements.ToDSType(True))
		except:
			failed.append(elements.ToDSType(True))
	TransactionManager.Instance.TransactionTaskDone()
	

if isinstance(IN[0], list):
	for i,sys in enumerate(UnwrapElement(IN[0])):
		RemoveFromCircuit(sys,UnwrapElement(IN[1])[i])
else:
	RemoveFromCircuit(UnwrapElement(IN[0]),UnwrapElement(IN[1]))

OUT = succes, failed
# ----------------------------------------
code_block = CodeBlock(x=python_script) { x[0]; }
Success = Output(code_block)
code_block_2 = CodeBlock(x=python_script) { x[1]; }
Failed = Output(code_block_2)
