# Dynamo custom node Element.Connectors.dyf (Dynamo 2.6.1.8786)
# category: MEPover.Revit.Connectors
# Returns every connector on an element (also return connectors of a System)

element = Input(element: var[]..[])
python_connector = Python(IN[0]=element)
# ---------- python_connector.python (44 lines) ----------
import clr
import math

clr.AddReference("RevitServices")
import RevitServices
from RevitServices.Persistence import DocumentManager
from RevitServices.Transactions import TransactionManager
doc = DocumentManager.Instance.CurrentDBDocument

clr.AddReference("RevitAPI")
import Autodesk
from Autodesk.Revit.DB import *

clr.AddReference("RevitNodes")
import Revit
clr.ImportExtensions(Revit.Elements)
clr.ImportExtensions(Revit.GeometryConversion)
#The inputs to this node will be stored as a list in the IN variables.
if isinstance(IN[0], list):
	elements = UnwrapElement(IN[0])
	toggle = 0
else:
	toggle = 1
	elements = [UnwrapElement(IN[0])]
	

listout = []

for element in elements:
	try:
		connectors = element.MEPModel.ConnectorManager.Connectors
	except:
		try:
			connectors = element.ConnectorManager.Connectors
		except:			
			connectors = []
	listout.append([x for x in connectors])


#Assign your output to the OUT variable.
if toggle:
	OUT = connectors
else:
	OUT = listout
# ----------------------------------------
Connectors = Output(python_connector)
