# Dynamo custom node Element.Domain.dyf (Dynamo 2.6.1.8786)
# category: MEPover.Revit.Elements
# Returns the domain of connectors on the element i.e. (domainHvac, domainPiping etc.)

element = Input(element: var[]..[])
python_script = Python(IN[0]=element)
# ---------- python_script.python (41 lines) ----------
import clr
clr.AddReference('ProtoGeometry')
from Autodesk.DesignScript.Geometry import *

#The inputs to this node will be stored as a list in the IN variables.
if isinstance(IN[0],list):
	toggle = 0
	element = UnwrapElement(IN[0])
else:
	toggle = 1
	element = [UnwrapElement(IN[0])]

def getDomain(elem):
	try:
		connectors = elem.ConnectorManager.Connectors
	except:
		connectors = elem.MEPModel.ConnectorManager.Connectors
	
	if connectors.Size < 2:	
		for conn in connectors:
			connector = conn
			break
		return connector.Domain
	else:
		domain = []
		for conn in connectors:
			domain.append(conn.Domain)
		return domain

listout = []	
for x in element:
	try:
		domains = getDomain(x)
		listout.append(domains)
	except:
		listout.append(None)
#Assign your output to the OUT variable.
if toggle:
	OUT = domains
else:
	OUT = listout
# ----------------------------------------
Domain = Output(python_script)
