# Dynamo custom node Element.ElectricalCircuit.dyf (Dynamo 2.6.1.8786)
# category: MEPover.Revit.Systems
# Returns the electrical circuit of the element

element = Input(element: var[]..[])
python_script = Python(IN[0]=element)
# ---------- python_script.python (36 lines) ----------
import clr
clr.AddReference('ProtoGeometry')
from Autodesk.DesignScript.Geometry import *

#The inputs to this node will be stored as a list in the IN variables.
if isinstance(IN[0],list):
	toggle = 0
	element = UnwrapElement(IN[0])
else:
	toggle = 1
	element = [UnwrapElement(IN[0])]

def getSystem(elem):
	system = elem.MEPModel.GetElectricalSystems()
	
	if system.Count == 0:
		return None
	elif system.Count == 1:	
		for sys in system:
			return sys
	else:
		return [x for x in system]

listout = []
system = None
for x in element:
	try:
		system = getSystem(x)
		listout.append(system)
	except:
		listout.append(None)
#Assign your output to the OUT variable.
if toggle:
	OUT = system
else:
	OUT = listout
# ----------------------------------------
Circuit = Output(python_script)
