# Dynamo custom node Element.System.dyf (Dynamo 2.6.1.8786)
# category: MEPover.Revit.Systems
# Returns the mechanical or plumbing system of the element

Elements = Input(Elements: var[]..[])
python_script = Python(IN[0]=Elements)
# ---------- python_script.python (54 lines) ----------
import clr
clr.AddReference('ProtoGeometry')
from Autodesk.DesignScript.Geometry import *

#The inputs to this node will be stored as a list in the IN variables.
if isinstance(IN[0],list):
	toggle = 0
	element = UnwrapElement(IN[0])
else:
	toggle = 1
	element = [UnwrapElement(IN[0])]

def getSystem(elem):
	try:
		system = elem.MEPSystem
		return system
	except:		
		try:
			connectors = elem.ConnectorManager.Connectors
		except:
			connectors = elem.MEPModel.ConnectorManager.Connectors
		
		if connectors.Size < 2:	
			for conn in connectors:
				connector = conn
				break
			return connector.MEPSystem
		else:
			systems = []
			ids = set()
			for conn in connectors:
				try:
					if conn.MEPSystem.Id not in ids:
						ids.add(conn.MEPSystem.Id)
						systems.append(conn.MEPSystem)
				except:
					pass
			return systems

listout = []	
for x in element:
	try:
		system = getSystem(x)
		if isinstance(system, list) and len(system) == 1:
			listout.append(system[0])
		else:
			listout.append(system)
	except:
		listout.append(None)
#Assign your output to the OUT variable.
if toggle:
	OUT = system
else:
	OUT = listout
# ----------------------------------------
Systems = Output(python_script)
