# Dynamo custom node FlexCurve.ByElements.dyf (Dynamo 2.6.1.8786)
# category: MEPover.Revit.Elements
# Creates a flex duct or flex pipe between 2 elements. Input IN[2] expects a FlexDuctType or FlexPipeType

element = Input(element: var[]..[])
element_2 = Input(element: var[]..[])
FlexMEPType = Input(FlexMEPType: var[]..[])
python_script = Python(IN[0]=element, IN[1]=element_2, IN[2]=FlexMEPType)
# ---------- python_script.python (156 lines) ----------
import clr

clr.AddReference("RevitServices")
import RevitServices
from RevitServices.Persistence import DocumentManager
from RevitServices.Transactions import TransactionManager
doc = DocumentManager.Instance.CurrentDBDocument

clr.AddReference("RevitAPI")
from Autodesk.Revit.DB import *

clr.AddReference("RevitNodes")
import Revit
clr.ImportExtensions(Revit.Elements)
clr.ImportExtensions(Revit.GeometryConversion)

clr.AddReference('System')		
from System.Collections.Generic import List

if isinstance(IN[0], list):
	pipe1 = UnwrapElement(IN[0])
else:
	pipe1 = [UnwrapElement(IN[0])]
if isinstance(IN[1], list):
	pipe2 = UnwrapElement(IN[1])
else:
	pipe2 = [UnwrapElement(IN[1])]
flextype = UnwrapElement(IN[2])


def closest_connectors(pipe1, pipe2):
	try:
		conn1 = pipe1.ConnectorManager.UnusedConnectors
	except:
		conn1 = pipe1.MEPModel.ConnectorManager.UnusedConnectors
	try:
		conn2 = pipe2.ConnectorManager.UnusedConnectors
	except:
		conn2 = pipe2.MEPModel.ConnectorManager.UnusedConnectors
	
	dist = 100000000
	connset = None
	for c in conn1:
		for d in conn2:
			conndist = c.Origin.DistanceTo(d.Origin)
			if conndist < dist:
				dist = conndist
				connset = [c,d]
	return connset
	
def createFlexPipe(conn1,conn2,starttan,endtan,levelid,systype):
	points = List[XYZ]([conn1.CoordinateSystem.Origin,conn2.CoordinateSystem.Origin])
	flex = Plumbing.FlexPipe.Create(doc,systype,flextype.Id,levelid,starttan,endtan,points)
	param = flex.get_Parameter(BuiltInParameter.RBS_PIPE_DIAMETER_PARAM)
	param.Set(conn1.Radius*2)
	return flex
	
def createFlexDuct(conn1,conn2,starttan,endtan,levelid,systype):
	points = List[XYZ]([conn1.CoordinateSystem.Origin,conn2.CoordinateSystem.Origin])
	flex = Mechanical.FlexDuct.Create(doc,systype,flextype.Id,levelid,starttan,endtan,points)
	round = True
	try:
		diameter = flex.Diameter
	except:
		round = False
	if round:
		param = flex.get_Parameter(BuiltInParameter.RBS_CURVE_DIAMETER_PARAM)
		if conn1.Shape == ConnectorProfileType.Round:
			param.Set(conn1.Radius*2)
		elif conn2.Shape == ConnectorProfileType.Round:
			param.Set(conn2.Radius*2)
		else:
			param.Set(conn1.Width)
			
	else:
		param_width = flex.get_Parameter(BuiltInParameter.RBS_CURVE_WIDTH_PARAM)
		param_height = flex.get_Parameter(BuiltInParameter.RBS_CURVE_HEIGHT_PARAM)
		if conn1.Shape == ConnectorProfileType.Rectangular:
			param_width.Set(conn1.Width)
			param_height.Set(conn1.Height)
		elif conn2.Shape == ConnectorProfileType.Rectangular:
			param_width.Set(conn2.Width)
			param_height.Set(conn2.Height)
		else:
			param_width.Set(conn1.Radius*2)
			param_height.Set(conn1.Radius*2)
	return flex

	
fittings = []

TransactionManager.Instance.EnsureInTransaction(doc)
for p1,p2 in zip(pipe1,pipe2):
	if p1.GetType() == Plumbing.Pipe or p1.GetType() == Mechanical.Duct:
		ptemp = p1
		p1 = p2
		p2 = ptemp
	
	connectors = closest_connectors(p1,p2)
	starttang = connectors[0].CoordinateSystem.BasisZ
	endtang = connectors[1].CoordinateSystem.BasisZ.Negate()
	if p1.GetType() == Plumbing.Pipe and p2.GetType() == Plumbing.Pipe or p1.GetType() == Mechanical.Duct and p2.GetType() == Mechanical.Duct:
		levelid = p1.ReferenceLevel.Id
	else:
		levelid = p1.LevelId
	
	line = Line.CreateUnbound(connectors[0].Origin,connectors[0].CoordinateSystem.BasisZ)
	point = line.Evaluate(10/304.8,False)

	points = List[XYZ]([point,connectors[1].Origin])
	
	if p2.GetType() == Mechanical.Duct:
		systypeId = p2.get_Parameter(BuiltInParameter.RBS_DUCT_SYSTEM_TYPE_PARAM).AsElementId()
		flex = createFlexDuct(connectors[0],connectors[1],starttang,endtang,levelid,systypeId)
	else:
		systypeId = p2.get_Parameter(BuiltInParameter.RBS_PIPING_SYSTEM_TYPE_PARAM).AsElementId()
		flex = createFlexPipe(connectors[0],connectors[1],starttang,endtang,levelid,systypeId)

	doc.Regenerate()

	
	conns = closest_connectors(flex,p1)
	if conns[0].Shape == ConnectorProfileType.Round and conns[1].Shape == ConnectorProfileType.Round:
		if conns[0].Radius == conns[1].Radius:
			conns[0].ConnectTo(conns[1])
		else:
			doc.Create.NewUnionFitting(conns[0],conns[1])
	elif conns[0].Shape != ConnectorProfileType.Round and conns[1].Shape != ConnectorProfileType.Round:
		if conns[0].Width == conns[1].Width and conns[0].Height == conns[1].Height:
			conns[0].ConnectTo(conns[1])
		else:
			doc.Create.NewUnionFitting(conns[0],conns[1])
	else:
		pass
		
	doc.Regenerate()
	conns = closest_connectors(flex,p2)
	if conns[0].Shape == ConnectorProfileType.Round and conns[1].Shape == ConnectorProfileType.Round:
		if conns[0].Radius == conns[1].Radius:
			conns[0].ConnectTo(conns[1])
		else:
			doc.Create.NewUnionFitting(conns[0],conns[1])
	elif conns[0].Shape != ConnectorProfileType.Round and conns[1].Shape != ConnectorProfileType.Round:
		if conns[0].Width == conns[1].Width and conns[0].Height == conns[1].Height:
			conns[0].ConnectTo(conns[1])
		else:
			doc.Create.NewUnionFitting(conns[0],conns[1])
	else:
		pass
	
	fittings.append(flex.ToDSType(False))
TransactionManager.Instance.TransactionTaskDone()

			

OUT = fittings
# ----------------------------------------
FlexMEP = Output(python_script)
