# Dynamo custom node GetParameterAsProjectUnits.dyf (Dynamo 2.12.0.5650)
# category: MEPover.Revit.Parameters
# Returns the parameter value in the same unit type as the project settings

Elements = Input(Elements: var[]..[])
ParameterName = Input(ParameterName: string)
python_script = Python(IN[0]=Elements, IN[1]=ParameterName)  # IronPython2
# ---------- python_script.python (52 lines) ----------
import clr
clr.AddReference('ProtoGeometry')
from Autodesk.DesignScript.Geometry import *
clr.AddReference('RevitAPI')
from Autodesk.Revit.DB import *
clr.AddReference("RevitServices")
import RevitServices
from RevitServices.Persistence import DocumentManager

doc = DocumentManager.Instance.CurrentDBDocument
uiapp = DocumentManager.Instance.CurrentUIApplication
app = uiapp.Application
version = int(app.VersionNumber)
#The inputs to this node will be stored as a list in the IN variables.
if isinstance(IN[0], list):
	element = UnwrapElement(IN[0])
else:
	element = [UnwrapElement(IN[0])]
name = IN[1]
listout = []

def checkParameter(param):
	for p in param:
		internal = p.Definition
		if internal.BuiltInParameter != BuiltInParameter.INVALID:
			return p
	return param[0]

for e in element:
	param = e.GetParameters(name)
	if len(param) == 0:
		listout.append(None)
	else:
		p = checkParameter(param)
		if p.StorageType == StorageType.String:
			listout.append(p.AsString())
		elif p.StorageType == StorageType.ElementId:
			elem = doc.GetElement(p.AsElementId())
			listout.append(elem)
		elif p.StorageType == StorageType.Double:
			if version < 2021:
				ProjectUnits = p.DisplayUnitType
			else:
				ProjectUnits = p.GetUnitTypeId()
			newval = UnitUtils.ConvertFromInternalUnits(p.AsDouble(),ProjectUnits)
			listout.append(newval)
		else:
			listout.append(p.AsInteger())
	

#Assign your output to the OUT variable.
OUT = listout
# ----------------------------------------
Values = Output(python_script)
