# Dynamo custom node GetParameterAsValueString.dyf (Dynamo 2.3.1.11775)
# category: MEPover.Revit.Parameters
# Returns the parameter values without conversion to the revit internal unit system. The suffix boolean toggles the project units on or off

Elements = Input(Elements: var[]..[])
ParameterName = Input(ParameterName: string)
Suffix = Input(Suffix: bool = false)
python_script = Python(IN[0]=Elements, IN[1]=ParameterName, IN[2]=Suffix)
# ---------- python_script.python (62 lines) ----------
import clr
clr.AddReference('ProtoGeometry')
from Autodesk.DesignScript.Geometry import *
clr.AddReference('RevitAPI')
from Autodesk.Revit.DB import *
clr.AddReference("RevitServices")
import RevitServices
from RevitServices.Persistence import DocumentManager

doc = DocumentManager.Instance.CurrentDBDocument
uiapp = DocumentManager.Instance.CurrentUIApplication
app = uiapp.Application
version = int(app.VersionNumber)
#The inputs to this node will be stored as a list in the IN variables.
if isinstance(IN[0], list):
	element = UnwrapElement(IN[0])
else:
	element = [UnwrapElement(IN[0])]
name = IN[1]
prefix = IN[2]
listout = []

if prefix == False:
	formatOptions = FormatOptions()
	formatOptions.UseDefault = False
	if version < 2021:
		formatOptions.UnitSymbol = UnitSymbolType.UST_NONE


def checkParameter(param):
	for p in param:
		internal = p.Definition
		if internal.BuiltInParameter != BuiltInParameter.INVALID:
			return p
	return param[0]

for e in element:
	param = e.GetParameters(name)
	if len(param) == 0:
		listout.append(None)
	else:
		p = checkParameter(param)
		if p.StorageType == StorageType.String:
			listout.append(p.AsString())
		elif p.StorageType == StorageType.ElementId:
			listout.append(p.AsValueString())
		elif p.StorageType == StorageType.Integer:
			listout.append(p.AsValueString())
		else:
			if prefix == False:
				if version < 2021:
					formatOptions.DisplayUnits = p.DisplayUnitType
				else:
					formatOptions.SetUnitTypeId(p.GetUnitTypeId())
				listout.append(p.AsValueString(formatOptions))
			else:
				listout.append(p.AsValueString())
			
	

#Assign your output to the OUT variable.
OUT = listout
# ----------------------------------------
Values = Output(python_script)
