# Dynamo custom node Linked file change paths.dyf (Dynamo 2.6.1.8786)
# category: MEPover.Revit.Links
# This node will allow you to change the path of a linked file without opening the file. All you need is a file path of the host model and the linked file

Host_file_path = Input(Host_file_path: var[]..[])
Old_linked_file_path = Input(Old_linked_file_path: var[]..[])
New_linked_file_path = Input(New_linked_file_path: var[]..[])
LoadLink = Input(LoadLink: bool = true)
python_change_link_path = Python(IN[0]=Host_file_path, IN[1]=Old_linked_file_path, IN[2]=New_linked_file_path, IN[3]=LoadLink)
# ---------- python_change_link_path.python (59 lines) ----------
import clr
clr.AddReference('ProtoGeometry')
from Autodesk.DesignScript.Geometry import *

from System.IO import FileInfo

# Import Element wrapper extension methods
clr.AddReference("RevitNodes")
import Revit
clr.ImportExtensions(Revit.Elements)

# Import geometry conversion extension methods
clr.ImportExtensions(Revit.GeometryConversion)

# Import DocumentManager and TransactionManager
clr.AddReference("RevitServices")
import RevitServices
from RevitServices.Persistence import DocumentManager
from RevitServices.Transactions import TransactionManager

doc = DocumentManager.Instance.CurrentDBDocument
uiapp = DocumentManager.Instance.CurrentUIApplication
app = uiapp.Application

# Import RevitAPI
clr.AddReference("RevitAPI")
import Autodesk
from Autodesk.Revit.DB import *

filein = FileInfo(IN[0])

oldLinkPath = IN[1]
newLinkPath = FilePath(IN[2])
load = IN[3]


try:
	filepath = filein.FullName
	
	modelpath = FilePath(filepath)
	path = ModelPathUtils.ConvertModelPathToUserVisiblePath(modelpath)
	transData = TransmissionData.ReadTransmissionData(modelpath)
	extRef = transData.GetAllExternalFileReferenceIds()
	
	for ref in extRef:
		ext = transData.GetLastSavedReferenceData(ref)
		currentlinkpath = ModelPathUtils.ConvertModelPathToUserVisiblePath(ext.GetAbsolutePath())
		
		if currentlinkpath == oldLinkPath:
			
			transData.SetDesiredReferenceData(ref,newLinkPath, PathType.Absolute,load)
		
			transData.IsTransmitted = True
			TransmissionData.WriteTransmissionData(modelpath,transData)
	result = "Succes"
except:
	result = "Failed"
	
OUT = result
# ----------------------------------------
Output = Output(python_change_link_path)  # ""
