# Dynamo custom node Linked file info by filepath.dyf (Dynamo 2.6.1.8786)
# category: MEPover.Revit.Links
# Returns linked file info: filepath, link type and link status

FilePath = Input(FilePath: var[]..[])
python = Python(IN[0]=FilePath)
# ---------- python.python (78 lines) ----------
import clr
clr.AddReference('ProtoGeometry')
from Autodesk.DesignScript.Geometry import *

from System.IO import FileInfo

# Import Element wrapper extension methods
clr.AddReference("RevitNodes")
import Revit
clr.ImportExtensions(Revit.Elements)

# Import geometry conversion extension methods
clr.ImportExtensions(Revit.GeometryConversion)

# Import DocumentManager and TransactionManager
clr.AddReference("RevitServices")
import RevitServices
from RevitServices.Persistence import DocumentManager
from RevitServices.Transactions import TransactionManager

doc = DocumentManager.Instance.CurrentDBDocument
uiapp = DocumentManager.Instance.CurrentUIApplication
app = uiapp.Application

# Import RevitAPI
clr.AddReference("RevitAPI")
import Autodesk
from Autodesk.Revit.DB import *

if isinstance(IN[0],list):
	toggle = 0
	if isinstance(IN[0][0], basestring):
		filein = [FileInfo(x) for x in IN[0]]
	else:
		filein = IN[0]
else:
	toggle = 1
	if isinstance(IN[0], basestring):
		filein = [FileInfo(IN[0])]
	else:
		filein = [IN[0]]
	

filepaths = [x.FullName for x in filein]
linkout = []
absout = []
typeout = []
statout = []
openoptions = OpenOptions()
openoptions.DetachFromCentralOption = DetachFromCentralOption.DetachAndPreserveWorksets
for filepath in filepaths:
	modelpath = FilePath(filepath)
	path = ModelPathUtils.ConvertModelPathToUserVisiblePath(modelpath)
	transData = TransmissionData.ReadTransmissionData(modelpath)
	extRef = transData.GetAllExternalFileReferenceIds()
	links = []
	absolute = []
	type = []
	linkstatus = []
	for ref in extRef:
		ext = transData.GetLastSavedReferenceData(ref)
		newpath = ModelPathUtils.ConvertModelPathToUserVisiblePath(ext.GetPath())
		abspath = ModelPathUtils.ConvertModelPathToUserVisiblePath(ext.GetAbsolutePath())
		status = ext.GetLinkedFileStatus()
		
		links.append(newpath)
		absolute.append(abspath)
		type.append(ext.ExternalFileReferenceType)
		linkstatus.append(status)
	linkout.append(links)
	absout.append(absolute)
	typeout.append(type)
	statout.append(linkstatus)
	
if toggle:
	OUT = links,absolute, type, linkstatus
else:
	OUT = linkout, absout, typeout, statout
# ----------------------------------------
code_block = CodeBlock(x=python) { x[0]; }
relative_paths = Output(code_block)
code_block_2 = CodeBlock(x=python) { x[1]; }
absolute_paths = Output(code_block_2)
code_block_3 = CodeBlock(x=python) { x[2]; }
Link_type = Output(code_block_3)
code_block_4 = CodeBlock(x=python) { x[3]; }
Link_status = Output(code_block_4)
