# Dynamo custom node MEP Curve connected fittings.dyf (Dynamo 2.6.1.8786)
# category: MEPover.Revit.Elements
# Returns the fittings, ducts accessories and terminals connected to the given duct, cable tray, pipe or conduit. Also return air terminals on Ducts

MEPCurves = Input(MEPCurves: var[]..[])
python_script = Python(IN[0]=MEPCurves)
# ---------- python_script.python (23 lines) ----------
import clr
clr.AddReference('ProtoGeometry')
from Autodesk.DesignScript.Geometry import *
#The inputs to this node will be stored as a list in the IN variables.
if isinstance(IN[0], list):
	curves = UnwrapElement(IN[0])
else:
	curves = [UnwrapElement(IN[0])]

refs = []

for curve in curves:
	connMan = curve.ConnectorManager
	fittings = []
	for conn in connMan.Connectors:
		if conn.IsConnected:
			for lc in conn.AllRefs:
				if connMan.Owner.Id !=  lc.Owner.Id:
					fittings.append(lc.Owner)
	refs.append(fittings)

#Assign your output to the OUT variable.
OUT = refs
# ----------------------------------------
Fittings = Output(python_script)
