# Dynamo custom node MEP Fitting connected MEPCurves.dyf (Dynamo 2.6.1.8786)
# category: MEPover.Revit.Elements
# Returns the pipes, ducts, conduits or cable trays that are connected to the given fittings

Fittings = Input(Fittings: var[]..[])
python_script = Python(IN[0]=Fittings)
# ---------- python_script.python (22 lines) ----------
import clr
clr.AddReference('ProtoGeometry')
from Autodesk.DesignScript.Geometry import *
#The inputs to this node will be stored as a list in the IN variables.
if isinstance(IN[0], list):
	fittings = UnwrapElement(IN[0])
else:
	fittings = [UnwrapElement(IN[0])]

refs = []

for x in fittings:
	connset = x.MEPModel.ConnectorManager.Connectors
	conn_pipes = []
	for c in connset:
		if c.IsConnected:
			for lc in c.AllRefs:
				conn_pipes.append(lc.Owner)
	refs.append(conn_pipes)

#Assign your output to the OUT variable.
OUT = refs
# ----------------------------------------
MEP_curves = Output(python_script)
