# Dynamo custom node MEP connector info.dyf (Dynamo 2.6.1.8786)
# category: MEPover.Revit.Elements
# Returns location, connector info and connected elements

element = Input(element: var[]..[])
python_script = Python(IN[0]=element)
# ---------- python_script.python (73 lines) ----------
import clr
import math

clr.AddReference("RevitServices")
import RevitServices
from RevitServices.Persistence import DocumentManager
from RevitServices.Transactions import TransactionManager
doc = DocumentManager.Instance.CurrentDBDocument

clr.AddReference("RevitAPI")
import Autodesk
from Autodesk.Revit.DB import *

clr.AddReference("RevitNodes")
import Revit
clr.ImportExtensions(Revit.Elements)
clr.ImportExtensions(Revit.GeometryConversion)
#The inputs to this node will be stored as a list in the IN variables.
if isinstance(IN[0], list):
	fittings = UnwrapElement(IN[0])
	toggle = 0
else:
	toggle = 1
	fittings = [UnwrapElement(IN[0])]
	
p = []
dir = []
rep = []
ref = []

for fitting in fittings:
	
	points = []
	direction = []
	report = []
	refs = []
	
	try:
		connectors = fitting.MEPModel.ConnectorManager.Connectors
	except:
		try:
			connectors = fitting.ConnectorManager.Connectors
		except:
			p.append(None)
			dir.append(None)
			rep.append(None)
			ref.append(None)
			continue
	for conn in connectors:
		points.append(conn.Origin.ToPoint())
		direction.append(conn.CoordinateSystem.BasisZ.ToVector())
		result = ""
		try:
			result += "Direction: " + conn.Direction.ToString()
		except:
			result += "Direction: N/A"
		result += ", AllRefs Size: " + conn.AllRefs.Size.ToString()
		result += ", Domain: " + conn.Domain.ToString()
		result += ", Type: " + conn.ConnectorType.ToString()
		report.append(result)
		for c in conn.AllRefs:
			refs.append(c.Owner)
	p.append(points)
	dir.append(direction)
	rep.append(report)
	ref.append(refs)


#Assign your output to the OUT variable.
if toggle:
	OUT = points, report, refs, direction
else:
	OUT = p,rep,ref, dir
# ----------------------------------------
code_block = CodeBlock(x=python_script) { x[0]; }
Points = Output(code_block)
code_block_2 = CodeBlock(x=python_script) { x[1]; }
Info = Output(code_block_2)
code_block_3 = CodeBlock(x=python_script) { x[2]; }
ConnectedElements = Output(code_block_3)
code_block_4 = CodeBlock(x=python_script) { x[3]; }
Direction = Output(code_block_4)
