# Dynamo custom node MEPCurveType.JunctionType.dyf (Dynamo 2.6.1.8786)
# category: MEPover.Revit.Elements
# Returns the preferred JunctionType (tap or tee) of a DuctType or PipeType

MEPCurveType = Input(MEPCurveType: var[]..[])
python_script = Python(IN[0]=MEPCurveType)
# ---------- python_script.python (36 lines) ----------
import clr

clr.AddReference("RevitServices")
import RevitServices
from RevitServices.Persistence import DocumentManager
from RevitServices.Transactions import TransactionManager
doc = DocumentManager.Instance.CurrentDBDocument

clr.AddReference("RevitAPI")
import Autodesk
from Autodesk.Revit.DB import *

clr.AddReference("RevitNodes")
import Revit
clr.ImportExtensions(Revit.Elements)
clr.ImportExtensions(Revit.GeometryConversion)

#Many thanks to Konrad K Sobon for his awesome ProcessList function!
def Unwrap(item):
	return UnwrapElement(item)

def ProcessList(_func, _list):
    return map( lambda x: ProcessList(_func, x) if type(x)==list else _func(x), _list )

if isinstance(IN[0], list):
	pipetypes = ProcessList(Unwrap, IN[0])
else:
	pipetypes = [Unwrap(IN[0])]
	
	
def getJunctionType(pipetype):
	return pipetype.RoutingPreferenceManager.PreferredJunctionType



OUT = ProcessList(getJunctionType, pipetypes)
# ----------------------------------------
JunctionType = Output(python_script)
