# Dynamo custom node MEPFitting.ByMEPCurves.dyf (Dynamo 2.6.1.8786)
# category: MEPover.Revit.Elements
# Creates a UnionFitting or ElbowFitting by 2 MEPCurves (Ducts, Cable Trays, Pipes or Conduits). The output may not always be all the fittings created as Revit sometimes creates extra transition fittings outside of the node transactions.

MEPCurve1 = Input(MEPCurve1: var[]..[])
MEPCurve2 = Input(MEPCurve2: var[]..[])
python_script = Python(IN[0]=MEPCurve1, IN[1]=MEPCurve2)
# ---------- python_script.python (72 lines) ----------
import clr

clr.AddReference("RevitServices")
import RevitServices
from RevitServices.Persistence import DocumentManager
from RevitServices.Transactions import TransactionManager
doc = DocumentManager.Instance.CurrentDBDocument

clr.AddReference("RevitAPI")
from Autodesk.Revit.DB import *

clr.AddReference("RevitNodes")
import Revit
clr.ImportExtensions(Revit.Elements)
clr.ImportExtensions(Revit.GeometryConversion)

if isinstance(IN[0], list):
	pipe1 = UnwrapElement(IN[0])
else:
	pipe1 = [UnwrapElement(IN[0])]
if isinstance(IN[1], list):
	pipe2 = UnwrapElement(IN[1])
else:
	pipe2 = [UnwrapElement(IN[1])]

def closest_connectors(pipe1, pipe2):
	conn1 = pipe1.ConnectorManager.Connectors
	conn2 = pipe2.ConnectorManager.Connectors
	
	dist = 100000000
	connset = None
	for c in conn1:
		for d in conn2:
			conndist = c.Origin.DistanceTo(d.Origin)
			if conndist < dist:
				dist = conndist
				connset = [c,d]
	return connset

	
def check_dir(conn1,conn2):
	if conn1.CoordinateSystem.BasisZ.ToString() == conn2.CoordinateSystem.BasisZ.ToString() or conn1.CoordinateSystem.BasisZ.ToString() == (conn2.CoordinateSystem.BasisZ*-1).ToString():
		return True
	else:
		return False
	
fittings = []

for p1,p2 in zip(pipe1,pipe2):
	connectors = closest_connectors(p1,p2)
	
	if check_dir(connectors[0],connectors[1]):
		TransactionManager.Instance.EnsureInTransaction(doc)
		
		fitting = doc.Create.NewUnionFitting(connectors[0],connectors[1])
		try:
			fittings.append(fitting.ToDSType(False))
		except:
			fittings.append("fitting not created by Dynamo")
		
		TransactionManager.Instance.TransactionTaskDone()
	else:
		TransactionManager.Instance.EnsureInTransaction(doc)
	
		fitting = doc.Create.NewElbowFitting(connectors[0],connectors[1])
		fittings.append(fitting.ToDSType(False))
		
		TransactionManager.Instance.TransactionTaskDone()

			

OUT = fittings
# ----------------------------------------
Fittings = Output(python_script)
