# Dynamo custom node MEPSystem.AddToSystem.dyf (Dynamo 2.6.1.8786)
# category: MEPover.Revit.Systems
# Add elements to a Duct or Pipe system

System = Input(System: var[]..[])
Elements = Input(Elements: var[]..[])
python_addtosystem = Python(IN[0]=System, IN[1]=Elements)
# ---------- python_addtosystem.python (95 lines) ----------
import clr

clr.AddReference("RevitServices")
import RevitServices
from RevitServices.Persistence import DocumentManager
from RevitServices.Transactions import TransactionManager
doc = DocumentManager.Instance.CurrentDBDocument

clr.AddReference("RevitAPI")
import Autodesk
from Autodesk.Revit.DB import *

clr.AddReference("RevitNodes")
import Revit
clr.ImportExtensions(Revit.Elements)
clr.ImportExtensions(Revit.GeometryConversion)


def AddToSystem(sys,terminals):
	result = []
	systype = sys.SystemType
	if systype.GetType() == Mechanical.DuctSystemType:
		TransactionManager.Instance.EnsureInTransaction(doc)
		if hasattr(terminals, "__iter__"):
			for terminal in terminals:
				try:
					connectors = terminal.MEPModel.ConnectorManager.Connectors
					for conn in connectors:
						try:
							if conn.DuctSystemType == systype:
								connset = ConnectorSet()
								connset.Insert(conn)
								sys.Add(connset)
								result.append(terminal)
						except:
							pass
				except:
					pass
		else:
			try:
				connectors = terminal.MEPModel.ConnectorManager.Connectors
				for conn in connectors:
					try:
						if conn.DuctSystemType == systype:
							connset = ConnectorSet()
							connset.Insert(conn)
							sys.Add(connset)
							result.append(terminal)
					except:
						pass
			except:
				pass
		TransactionManager.Instance.TransactionTaskDone()
	else:
		TransactionManager.Instance.EnsureInTransaction(doc)
		if hasattr(terminals, "__iter__"):
			for terminal in terminals:
				try:
					connectors = terminal.MEPModel.ConnectorManager.Connectors
					for conn in connectors:
						try:
							if conn.PipeSystemType == systype:
								connset = ConnectorSet()
								connset.Insert(conn)
								sys.Add(connset)
								result.append(terminal)
						except:
							pass
				except:
					pass
		else:
			try:
				connectors = terminal.MEPModel.ConnectorManager.Connectors
				for conn in connectors:
					try:
						if conn.PipeSystemType == systype:
							connset = ConnectorSet()
							connset.Insert(conn)
							sys.Add(connset)
							result.append(terminal)
					except:
						pass
			except:
				pass
		TransactionManager.Instance.TransactionTaskDone()
	return result

listout = []
if isinstance(IN[0], list):
	for i,sys in enumerate(UnwrapElement(IN[0])):
		listout.append(AddToSystem(sys,UnwrapElement(IN[1])[i]))
else:
	listout.append(AddToSystem(UnwrapElement(IN[0]),UnwrapElement(IN[1])))

OUT = listout
# ----------------------------------------
Result = Output(python_addtosystem)
