# Dynamo custom node MEPSystem.CreateSystem.dyf (Dynamo 2.6.1.8786)
# category: MEPover.Revit.Systems
# Creates a duct or piping system by providing a Mechanical- or PipingSystemType. Optional names can be provided for the systems

SystemType = Input(SystemType: var[]..[])
Names = Input(Names: string)
python_create_system = Python(IN[0]=SystemType, IN[1]=Names)
# ---------- python_create_system.python (66 lines) ----------
import clr

clr.AddReference("RevitServices")
import RevitServices
from RevitServices.Persistence import DocumentManager
from RevitServices.Transactions import TransactionManager
doc = DocumentManager.Instance.CurrentDBDocument

clr.AddReference("RevitAPI")
import Autodesk
from Autodesk.Revit.DB import *

clr.AddReference("RevitNodes")
import Revit
clr.ImportExtensions(Revit.Elements)
clr.ImportExtensions(Revit.GeometryConversion)

if isinstance(IN[0], list):
	systemtypes = UnwrapElement(IN[0])
else:
	systemtypes = [UnwrapElement(IN[0])]
sl = len(systemtypes)	
	
if isinstance(IN[1], list):
	systemnames = IN[1]
else:
	systemnames = [IN[1]]

listout = []
if IN[1] != None:
	TransactionManager.Instance.EnsureInTransaction(doc)
	for i,name in enumerate(systemnames):
		sys = systemtypes[i%sl]
		if sys.GetType() == Plumbing.PipeSystemType:
			#try:
			newsys = Plumbing.PipingSystem.Create(doc,sys.Id,name)
			listout.append(newsys.ToDSType(False))
			#except:
				#pass
		else:
			#try:
			newsys = Mechanical.MechanicalSystem.Create(doc,sys.Id,name)
			listout.append(newsys.ToDSType(False))
			#except:
				#pass
		
	TransactionManager.Instance.TransactionTaskDone()
else:
	TransactionManager.Instance.EnsureInTransaction(doc)
	for sys in systemtypes:
		if sys.GetType() == Plumbing.PipeSystemType:
			try:
				newsys = Plumbing.PipingSystem.Create(doc,sys.Id)
				listout.append(newsys.ToDSType(False))
			except:
				pass
		else:
			try:
				newsys = Mechanical.MechanicalSystem.Create(doc,sys.Id)
				listout.append(newsys.ToDSType(False))
			except:
				pass
		
	TransactionManager.Instance.TransactionTaskDone()

OUT = listout
# ----------------------------------------
Systems = Output(python_create_system)
