# Dynamo custom node MEPSystem.RemoveFromSystem.dyf (Dynamo 2.0.3.8810)
# category: MEPover.Revit.Systems
# Remove elements from a Duct or Pipe system

system = Input(system: var[]..[])
element = Input(element: var[]..[])
python_removefromsystem = Python(IN[0]=system, IN[1]=element)
# ---------- python_removefromsystem.python (56 lines) ----------
import clr

clr.AddReference("RevitServices")
import RevitServices
from RevitServices.Persistence import DocumentManager
from RevitServices.Transactions import TransactionManager
doc = DocumentManager.Instance.CurrentDBDocument

clr.AddReference("RevitAPI")
import Autodesk
from Autodesk.Revit.DB import *

clr.AddReference("RevitNodes")
import Revit
clr.ImportExtensions(Revit.Elements)
clr.ImportExtensions(Revit.GeometryConversion)


def RemoveFromSystem(sys,terminal):
	result = []
	systype = sys.SystemType
	if systype.GetType() == Mechanical.DuctSystemType:
		TransactionManager.Instance.EnsureInTransaction(doc)
		try:
			connectors = terminal.MEPModel.ConnectorManager.Connectors
			for conn in connectors:
				try:
					if conn.DuctSystemType == systype:
						connset = ConnectorSet()
						connset.Insert(conn)
						sys.Remove(connset)
						result.append(terminal)
				except:
					pass
		except:
			pass
		TransactionManager.Instance.TransactionTaskDone()
	else:
		TransactionManager.Instance.EnsureInTransaction(doc)
		try:
			connectors = terminal.MEPModel.ConnectorManager.Connectors
			for conn in connectors:
				try:
					if conn.PipeSystemType == systype:
						connset = ConnectorSet()
						connset.Insert(conn)
						sys.Remove(connset)
						result.append(terminal)
				except:
					pass
		except:
			pass
		TransactionManager.Instance.TransactionTaskDone()
	return result
	
OUT = RemoveFromSystem(UnwrapElement(IN[0]),UnwrapElement(IN[1]))
# ----------------------------------------
result = Output(python_removefromsystem)
