# Dynamo custom node Mechanical System Graphic Override set LineColor.dyf (Dynamo 2.6.1.8786)
# category: MEPover.Revit.Systems
# Sets the linecolor of the mechanical system graphic override

SystemType = Input(SystemType: var[]..[])
Red = Input(Red: int)
Green = Input(Green: int)
Blue = Input(Blue: int)
python_script = Python(IN[0]=SystemType, IN[1]=Red, IN[2]=Green, IN[3]=Blue)
# ---------- python_script.python (43 lines) ----------
import clr
clr.AddReference('ProtoGeometry')
from Autodesk.DesignScript.Geometry import *
import clr

clr.AddReference("RevitServices")
import RevitServices
from RevitServices.Persistence import DocumentManager
from RevitServices.Transactions import TransactionManager
doc = DocumentManager.Instance.CurrentDBDocument

clr.AddReference("RevitAPI")
from Autodesk.Revit.DB import *
#The inputs to this node will be stored as a list in the IN variables.
toggle = ""
if isinstance(IN[0],list):
	systems = UnwrapElement(IN[0])
else:
	systems = [UnwrapElement(IN[0])]
if isinstance(IN[1],list):
	red = IN[1]
	green = IN[2]
	blue = IN[3]
else:
	toggle = "1"
	red = [IN[1]]
	green = [IN[2]]
	blue = [IN[3]]


TransactionManager.Instance.EnsureInTransaction(doc)
if toggle == "1":
	for i,sys in enumerate(systems):
		color = Color(red[0],green[0],blue[0])
		sys.LineColor = color
else:
	for i,sys in enumerate(systems):
		color = Color(red[i],green[i],blue[i])
		sys.LineColor = color
TransactionManager.Instance.TransactionTaskDone()

#Assign your output to the OUT variable.
OUT = [sys.LineColor for sys in systems]
# ----------------------------------------
LineColor = Output(python_script)
