# Dynamo custom node Mechanical System Graphic Override set LinePattern.dyf (Dynamo 2.6.1.8786)
# category: MEPover.Revit.Systems
# Sets the line pattern in the mechanical system type's graphic override

SystemType = Input(SystemType: var[]..[])
linePatternElement = Input(linePatternElement: var[]..[])
python_script = Python(IN[0]=SystemType, IN[1]=linePatternElement)
# ---------- python_script.python (37 lines) ----------
import clr
clr.AddReference('ProtoGeometry')
from Autodesk.DesignScript.Geometry import *
import clr

clr.AddReference("RevitServices")
import RevitServices
from RevitServices.Persistence import DocumentManager
from RevitServices.Transactions import TransactionManager
doc = DocumentManager.Instance.CurrentDBDocument

clr.AddReference("RevitAPI")
from Autodesk.Revit.DB import *

toggle = ""
if isinstance(IN[0],list):
	systems = UnwrapElement(IN[0])
else:
	systems = [UnwrapElement(IN[0])]
if isinstance(IN[1],list):
	pattern = UnwrapElement(IN[1])
else:
	toggle += "1"
	pattern = [UnwrapElement(IN[1])]

if toggle == "1":
	TransactionManager.Instance.EnsureInTransaction(doc)
	for sys in systems:
		sys.LinePatternId = pattern[0].Id
	TransactionManager.Instance.TransactionTaskDone()
else:
	TransactionManager.Instance.EnsureInTransaction(doc)
	for pat,sys in zip(pattern,systems):
		sys.LinePatternId = pat.Id
	TransactionManager.Instance.TransactionTaskDone()
#Assign your output to the OUT variable.
OUT = [sys.LinePatternId for sys in systems]
# ----------------------------------------
LinePatternElement = Output(python_script)
