# Dynamo custom node Mechanical System Graphic Override set Lineweight.dyf "Mechanical System Graphic Override set LineWeight" (Dynamo 2.6.1.8786)
# category: MEPover.Revit.Systems
# This will change the lineweight override of the mechanical system type

SystemType = Input(SystemType: var[]..[])
Lineweight = Input(Lineweight: int)
python_script = Python(IN[0]=SystemType, IN[1]=Lineweight)
# ---------- python_script.python (34 lines) ----------
import clr
clr.AddReference('ProtoGeometry')
from Autodesk.DesignScript.Geometry import *
import clr

clr.AddReference("RevitServices")
import RevitServices
from RevitServices.Persistence import DocumentManager
from RevitServices.Transactions import TransactionManager
doc = DocumentManager.Instance.CurrentDBDocument
#The inputs to this node will be stored as a list in the IN variables.
toggle = ""
if isinstance(IN[0],list):
	systems = UnwrapElement(IN[0])
else:
	systems = [UnwrapElement(IN[0])]
if isinstance(IN[1],list):
	lineweight = IN[1]
else:
	toggle += "1"
	lineweight = [IN[1]]

if toggle == "1":
	TransactionManager.Instance.EnsureInTransaction(doc)
	for sys in systems:
		sys.LineWeight = lineweight[0]
	TransactionManager.Instance.TransactionTaskDone()
else:
	TransactionManager.Instance.EnsureInTransaction(doc)
	for line,sys in zip(lineweight,systems):
		sys.LineWeight = line
	TransactionManager.Instance.TransactionTaskDone()
#Assign your output to the OUT variable.
OUT = [sys.LineWeight for sys in systems]
# ----------------------------------------
Lineweight_2 = Output(python_script)  # "Lineweight"
