# Dynamo custom node MechanicalFitting info.dyf (Dynamo 2.6.1.8786)
# category: MEPover.Revit.Elements
# Gets the fitting Part Type and number of connectors

Fittings = Input(Fittings: var[]..[])
python_script = Python(IN[0]=Fittings)
# ---------- python_script.python (18 lines) ----------
import clr
clr.AddReference('ProtoGeometry')
from Autodesk.DesignScript.Geometry import *
#The inputs to this node will be stored as a list in the IN variables.
if isinstance(IN[0], list):
	fittings = UnwrapElement(IN[0])
else:
	fittings = [UnwrapElement(IN[0])]
	
count = []
types = []

for x in fittings:
	count.append(x.MEPModel.ConnectorManager.Connectors.Size)
	types.append(x.MEPModel.PartType)

#Assign your output to the OUT variable.
OUT = count, types
# ----------------------------------------
code_block = CodeBlock(x=python_script) { x[0]; }
Connector_Count = Output(code_block)
code_block_2 = CodeBlock(x=python_script) { x[1]; }
Part_Type = Output(code_block_2)
