# Dynamo custom node Nearest value from list of values.dyf (Dynamo 2.6.1.8786)
# category: MEPover.Math
# Finds the nearest values from a given list of values

Value = Input(Value: var[]..[])
ListOfValues = Input(ListOfValues: var[]..[])
python_script = Python(IN[0]=Value, IN[1]=ListOfValues)
# ---------- python_script.python (24 lines) ----------
import clr
clr.AddReference('ProtoGeometry')
from Autodesk.DesignScript.Geometry import *
#The inputs to this node will be stored as a list in the IN variables.
if isinstance(IN[0], list):
	keys = IN[0]
	toggle = 0
else:
	keys = [IN[0]]
	toggle = 1
search = IN[1]

def nearest(key, lov):
	return min(lov, key = lambda x:abs(x-key))
	
listout = []
for k in keys:
	listout.append(nearest(k,search))

#Assign your output to the OUT variable.
if toggle:
	OUT = listout[0]
else:
	OUT = listout
# ----------------------------------------
Nearest = Output(python_script)
