# Dynamo custom node PanelScheduleView.NumberOfAssignedCircuits.dyf (Dynamo 2.6.1.8786)
# category: MEPover.Revit.PanelSchedule
# This will return the number of assigned circuits on a panelschedule. Spares and spaces also count as an assigned circuit.

PanelScheduleView = Input(PanelScheduleView: var[]..[])
python_script = Python(IN[0]=PanelScheduleView)
# ---------- python_script.python (59 lines) ----------
import clr

clr.AddReference("RevitServices")
import RevitServices
from RevitServices.Persistence import DocumentManager
from RevitServices.Transactions import TransactionManager
doc = DocumentManager.Instance.CurrentDBDocument

clr.AddReference("RevitAPI")
import Autodesk
from Autodesk.Revit.DB import *

clr.AddReference("RevitNodes")
import Revit
clr.ImportExtensions(Revit.Elements)
clr.ImportExtensions(Revit.GeometryConversion)

#Many thanks to Konrad K Sobon for his awesome ProcessList function!
def Unwrap(item):
	return UnwrapElement(item)

def ProcessList(_func, _list):
    return map( lambda x: ProcessList(_func, x) if type(x)==list else _func(x), _list )

if isinstance(IN[0], list):
	panelschedule = ProcessList(Unwrap, IN[0])
else:
	panelschedule = [Unwrap(IN[0])]
	
	
def GetNumber(panelschedule):
	i = 0
	number = 0
	foundcircuit = False
	while True:
		if panelschedule.GetTableData().GetNumberOfCircuitRows() < i:
			break
		circuit = panelschedule.GetCircuitByCell(i,0)
		if circuit == None and foundcircuit == True:
			break
		if circuit == None and foundcircuit == False:
			i += 1
			continue
		if circuit.GetType() == Electrical.ElectricalSystem and foundcircuit == False:
			foundcircuit = True
			number += 1
			i += 1
			continue
		if circuit.GetType() != Electrical.ElectricalSystem:
			break
		number += 1
		i += 1
		if number > 1000:
			break
	return number



OUT = ProcessList(GetNumber, panelschedule)
# ----------------------------------------
Number = Output(python_script)
