# Dynamo custom node PanelScheduleView_by_PanelName.dyf (Dynamo 2.13.1.3887)
# category: MEPover.Revit.PanelSchedule
# Returns a Panel Schedule View by supplying the Panel Name value. Will only return a Panel Schedule View if it has been created, otherwise it returns null

Panel_Name = Input(Panel_Name: string)
panelscheduleview_by_panelname = Python(IN[0]=Panel_Name)  # CPython3
# ---------- panelscheduleview_by_panelname.python (32 lines) ----------
import clr

clr.AddReference("RevitServices")
import RevitServices
from RevitServices.Persistence import DocumentManager
from RevitServices.Transactions import TransactionManager
doc = DocumentManager.Instance.CurrentDBDocument

clr.AddReference("RevitAPI")
import Autodesk
from Autodesk.Revit.DB import *

clr.AddReference("RevitNodes")
import Revit
clr.ImportExtensions(Revit.Elements)
clr.ImportExtensions(Revit.GeometryConversion)


panelname = IN[0]

listout = []
panelviews = FilteredElementCollector(doc).OfClass(Electrical.PanelScheduleView).ToElements()

paneldict = {}
for panelview in panelviews:
	paneldict[panelview.Name] = panelview


if panelname in paneldict:
	OUT = paneldict[panelname]
else:
	OUT = None
# ----------------------------------------
PanelScheduleView = Output(panelscheduleview_by_panelname)
