# Dynamo custom node Pipe.ByConnectorEndpoint.dyf (Dynamo 2.6.1.8786)
# category: MEPover.Revit.Elements
# Creates a pipe from the connector to the given point.

connector = Input(connector: var[]..[])
point = Input(point: var[]..[])
PipeType = Input(PipeType: var[]..[])
level = Input(level: var[]..[])
python_script = Python(IN[0]=connector, IN[1]=point, IN[2]=PipeType, IN[3]=level)
# ---------- python_script.python (54 lines) ----------
import clr

clr.AddReference("RevitServices")
import RevitServices
from RevitServices.Persistence import DocumentManager
from RevitServices.Transactions import TransactionManager
doc = DocumentManager.Instance.CurrentDBDocument

clr.AddReference("RevitAPI")
import Autodesk
from Autodesk.Revit.DB import *

clr.AddReference("RevitNodes")
import Revit
clr.ImportExtensions(Revit.Elements)
clr.ImportExtensions(Revit.GeometryConversion)

toggle = 0

if isinstance(IN[0], list):
	connector1 = IN[0]
else:
	connector1 = [IN[0]]
	toggle = 1
if isinstance(IN[1], list):
	point = IN[1]
else:
	point = [IN[1]]
pipetype = UnwrapElement(IN[2])
if isinstance(IN[3], list):
	level = UnwrapElement(IN[3])
else:
	level = [UnwrapElement(IN[3])]
ll = len(level)


elements = []

TransactionManager.Instance.EnsureInTransaction(doc)
for i,conn1 in enumerate(connector1):
	try:
		levelid = level[i%ll].Id
		pipe = Autodesk.Revit.DB.Plumbing.Pipe.Create(doc,pipetype.Id,levelid,conn1,point[i].ToXyz())
	
		elements.append(pipe.ToDSType(False))
	except:
		elements.append(None)

TransactionManager.Instance.TransactionTaskDone()

if toggle:
	OUT = elements[0]
else:
	OUT = elements
# ----------------------------------------
pipe = Output(python_script)
