# Dynamo custom node PipeSegment.SetName.dyf (Dynamo 2.6.1.8786)
# category: MEPover.Revit.Parameters
# Changes the name of the pipe segment (found under MEP Settings)

Pipe_Segments = Input(Pipe_Segments: var[]..[])
Name = Input(Name: string)
python_script = Python(IN[0]=Pipe_Segments, IN[1]=Name)
# ---------- python_script.python (30 lines) ----------
import clr

clr.AddReference("RevitServices")
import RevitServices
from RevitServices.Persistence import DocumentManager
from RevitServices.Transactions import TransactionManager
doc = DocumentManager.Instance.CurrentDBDocument

clr.AddReference("RevitAPI")
import Autodesk
from Autodesk.Revit.DB import *

clr.AddReference("RevitNodes")
import Revit
clr.ImportExtensions(Revit.Elements)
clr.ImportExtensions(Revit.GeometryConversion)
#The inputs to this node will be stored as a list in the IN variables.
segments = UnwrapElement(IN[0])

names = IN[1]


TransactionManager.Instance.EnsureInTransaction(doc)

segments.Name = names

TransactionManager.Instance.TransactionTaskDone()

#Assign your output to the OUT variable.
OUT = segments
# ----------------------------------------
Pipe_Segments_2 = Output(python_script)  # "Pipe Segments"
