# Dynamo custom node PipingSystem network size.dyf (Dynamo 2.6.1.8786)
# category: MEPover.Revit.Systems
# Returns the number of elements in the piping network

PipingSystem = Input(PipingSystem: var[]..[])
python_pipe_network_size = Python(IN[0]=PipingSystem)
# ---------- python_pipe_network_size.python (42 lines) ----------
import clr

clr.AddReference("RevitServices")
import RevitServices
from RevitServices.Persistence import DocumentManager
from RevitServices.Transactions import TransactionManager
doc = DocumentManager.Instance.CurrentDBDocument

clr.AddReference("RevitAPI")
import Autodesk
from Autodesk.Revit.DB import *

clr.AddReference("RevitNodes")
import Revit
clr.ImportExtensions(Revit.Elements)
clr.ImportExtensions(Revit.GeometryConversion)

#Many thanks to Konrad K Sobon for his awesome ProcessList function!
def Unwrap(item):
	return UnwrapElement(item)

def ProcessList(_func, _list):
    return map( lambda x: ProcessList(_func, x) if type(x)==list else _func(x), _list )

if isinstance(IN[0], list):
	systems = ProcessList(Unwrap, IN[0])
else:
	systems = [Unwrap(IN[0])]
	
	
def getSystemSize(system):
	count = None
	try:
		count = system.PipingNetwork.Size
	except:
		pass
	return count

			
#Assign your output to the OUT variable.

OUT = ProcessList(getSystemSize, systems)
# ----------------------------------------
count = Output(python_pipe_network_size)
