# Dynamo custom node Room or Space reset center location.dyf (Dynamo 2.0.3.8810)
# category: MEPover.Revit.RoomsAndSpaces
# This node will attempt to reset the location of the room or space to its default center location

Rooms_Spaces = Input(Rooms_Spaces: var[]..[])
python_script = Python(IN[0]=Rooms_Spaces)
# ---------- python_script.python (56 lines) ----------
import clr

clr.AddReference("RevitServices")
import RevitServices
from RevitServices.Persistence import DocumentManager
from RevitServices.Transactions import TransactionManager
doc = DocumentManager.Instance.CurrentDBDocument

clr.AddReference("RevitAPI")
import Autodesk
from Autodesk.Revit.DB import *

clr.AddReference("RevitNodes")
import Revit
clr.ImportExtensions(Revit.Elements)
clr.ImportExtensions(Revit.GeometryConversion)

if isinstance(IN[0],list):
	rooms = UnwrapElement(IN[0])
else:
	rooms = [UnwrapElement(IN[0])]
	
listout = []
locations = []

for room in rooms:
	levelId = room.get_Parameter(BuiltInParameter.ROOM_LEVEL_ID).AsElementId()
	level = doc.GetElement(levelId)
	compuheight = level.get_Parameter(BuiltInParameter.LEVEL_ROOM_COMPUTATION_HEIGHT).AsDouble()
	try:
		planTopology = doc.get_PlanTopology(level)
		for plancircuit in planTopology.Circuits:
			if room.GetType() == Architecture.Room:
				if plancircuit.IsRoomLocated == True:
					UvPoint = plancircuit.GetPointInside()
					point = XYZ(UvPoint.U,UvPoint.V,compuheight)
					if room.IsPointInRoom(point):
						break
			else:
				try:
					UvPoint = plancircuit.GetPointInside()
					point = XYZ(UvPoint.U,UvPoint.V,compuheight)
					if room.IsPointInSpace(point):
						break
				except:
					continue
		TransactionManager.Instance.EnsureInTransaction(doc)
		room.Location.Point = point
		TransactionManager.Instance.TransactionTaskDone()
		listout.append(room)
		locations.append(point.ToPoint())
	except:
		listout.append(None)
		locations.append(None)

OUT = listout, locations
# ----------------------------------------
code_block = CodeBlock(x=python_script) { x[0]; }
Rooms_Spaces_2 = Output(code_block)  # "Rooms/Spaces"
code_block_2 = CodeBlock(x=python_script) { x[1]; }
Locations = Output(code_block_2)
