# Dynamo custom node Space number to duct network.dyf (Dynamo 2.6.1.8786)
# category: MEPover.Revit.RoomsAndSpaces
# This node will attempt to write the space number to connected duct objects in the network. Input AirTerminals need to be placed in spaces. ParameterName is the parameter to write the space number to. Numbering stops when it encounters an element from another space. Multiple Categories supported

Air_Terminals = Input(Air_Terminals: var[]..[])
ParameterName = Input(ParameterName: string)
category = Input(category: var[]..[])
SizeLimitFactor = Input(SizeLimitFactor: int = 20)
python_script = Python(IN[0]=Air_Terminals, IN[1]=ParameterName, IN[2]=category, IN[3]=SizeLimitFactor)
# ---------- python_script.python (208 lines) ----------
import clr
import math

clr.AddReference("RevitServices")
import RevitServices
from RevitServices.Persistence import DocumentManager
from RevitServices.Transactions import TransactionManager
doc = DocumentManager.Instance.CurrentDBDocument

clr.AddReference("RevitAPI")
import Autodesk
from Autodesk.Revit.DB import *

clr.AddReference("RevitNodes")
import Revit
clr.ImportExtensions(Revit.Elements)
clr.ImportExtensions(Revit.GeometryConversion)
#The inputs to this node will be stored as a list in the IN variables.
if isinstance(IN[0], list):
	elements = UnwrapElement(IN[0])
else:
	elements = [UnwrapElement(IN[0])]
	
def getSize(x):
	try:
		conns = x.ConnectorManager.Connectors
	except:
		conns = x.MEPModel.ConnectorManager.Connectors
	maxsize = 0
	for c in conns:
		if c.Shape == ConnectorProfileType.Round:
			startsize = c.Radius * 2
		elif c.Shape == ConnectorProfileType.Invalid:
			continue
		else:
			area = c.Width * c.Height
			startsize = (math.sqrt(area/math.pi) * 2)
		if startsize > maxsize:
			maxsize = startsize
	return maxsize
	
phaseId = elements[0].CreatedPhaseId
phase = doc.GetElement(phaseId)
name = IN[1]
if isinstance(IN[2], list):
	category = UnwrapElement(IN[2])
else:
	category = [UnwrapElement(IN[2])]
	
factor = IN[3]

catIds = []
for c in category:
	catIds.append(c.Id)

def checkParameter(param):
	for p in param:
		internal = p.Definition
		if internal.BuiltInParameter != BuiltInParameter.INVALID:
			return p
	return param[0]


def nextElement(elem,sys):
	sysname = next.get_Parameter(BuiltInParameter.RBS_SYSTEM_CLASSIFICATION_PARAM).AsString()
	for s in sysname.split(","):
		if s in sys.split(","):
			break
	else:
		return 4
	if "Return Air" in sysname:
		direction = FlowDirectionType.In
	else:
		direction = FlowDirectionType.Out
	try:
		connectors = elem.ConnectorManager.Connectors
		for conn in connectors:
			if conn.Domain != Domain.DomainHvac:
				continue
			elif conn.Direction == direction:
				continue
			else:
				endconn = conn
		for c in endconn.AllRefs:
			if c.Owner.Id.Equals(elem.Id):
				continue
			elif c.Owner.GetType() == Mechanical.MechanicalSystem:
				return 0
			else:
				newelem = c.Owner
		return newelem
	except AttributeError:
		connectors = elem.MEPModel.ConnectorManager.Connectors
		if connectors.Size == 1:
			for conn in connectors:
				if conn.Domain != Domain.DomainHvac:
					continue
				endconn = conn
			if endconn.AllRefs.Size == 1:
				for c in endconn.AllRefs:
					if c.Owner.GetType() == Mechanical.MechanicalSystem:
						return 1
			for c in endconn.AllRefs:
				if c.Owner.Id.Equals(elem.Id):
					continue
				elif c.Owner.GetType() == Mechanical.MechanicalSystem:
					continue
				else:
					newelem = c.Owner
			return newelem
		elif connectors.Size == 2:
			for conn in connectors:
				if conn.Domain != Domain.DomainHvac:
					continue
				if conn.Direction == direction:
					continue
				else:
					endconn = conn
			if endconn.AllRefs.Size == 1:
				for c in endconn.AllRefs:
					if c.Owner.GetType() == Mechanical.MechanicalSystem:
						return 2
			for c in endconn.AllRefs:
				if c.Owner.Id.Equals(elem.Id):
					continue
				elif c.Owner.GetType() == Mechanical.MechanicalSystem:
					continue
				else:
					newelem = c.Owner
			return newelem
		else:
			for conn in connectors:
				if conn.Domain != Domain.DomainHvac:
					continue
				if conn.Direction != direction:
					endconn = conn
			if endconn.AllRefs.Size == 1:
				for c in endconn.AllRefs:
					if c.Owner.GetType() == Mechanical.MechanicalSystem:
						return 3
			for c in endconn.AllRefs:
				if c.Owner.Id.Equals(elem.Id):
					continue
				elif c.Owner.GetType() == Mechanical.MechanicalSystem:
					continue
				else:
					newelem = c.Owner
			return newelem



listout = []
result = []
ids = []
for j,x in enumerate(elements):
	space = x.Space[phase]
	if space == None:
		listout.append("ElementId "+str(x.Id)+" is not in a space")
		continue
	spacenumber = space.Number
	sysclass = x.get_Parameter(BuiltInParameter.RBS_SYSTEM_CLASSIFICATION_PARAM).AsString()
	startsize = getSize(x)
	next = x
	i = 0
	while True:
		if i > 1000:
			break
		try:
			next = nextElement(next,sysclass)
		except:
			result.append("error")
			break
		if isinstance(next, int):
			result.append("can't get next element")
			i += 1
			break
		i += 1
		nextsize = getSize(next)
		if nextsize > startsize * factor:
			result.append("size end")
			break
		if next.Category.Id not in catIds:
			i += 1
			continue
		p = next.GetParameters(name)
		if len(p) == 0:
			result.append("no param")
			break
		else:
			param = checkParameter(p)
		elem_num = param.AsString()
		if elem_num == None or elem_num == "" and next.Id not in ids:
			TransactionManager.Instance.EnsureInTransaction(doc)
			param.Set(spacenumber)
			TransactionManager.Instance.TransactionTaskDone()
		elif elem_num == spacenumber:
			continue
		elif elem_num != None or elem_num != "" and elem_num != spacenumber:
			TransactionManager.Instance.EnsureInTransaction(doc)
			param.Set("")
			TransactionManager.Instance.TransactionTaskDone()
			ids.append(next.Id)
		else:
			break
	listout.append(x)

#Assign your output to the OUT variable.
OUT = listout, result
# ----------------------------------------
code_block = CodeBlock(x=python_script) { x[0]; }
Elements = Output(code_block)
