# Dynamo custom node SpaceAtRoom.dyf (Dynamo 2.6.1.8786)
# category: MEPover.Revit.RoomsAndSpaces
# Input a (linked) room and this node will create a space in the selected phase at the same place and level as the room.

Rooms = Input(Rooms: var[]..[])
Phase = Input(Phase: var[]..[])
python_script = Python(IN[0]=Rooms, IN[1]=Phase)
# ---------- python_script.python (97 lines) ----------
import clr
import math

clr.AddReference("RevitServices")
import RevitServices
from RevitServices.Persistence import DocumentManager
from RevitServices.Transactions import TransactionManager
doc = DocumentManager.Instance.CurrentDBDocument

clr.AddReference("RevitAPI")
import Autodesk
from Autodesk.Revit.DB import *

clr.AddReference("RevitNodes")
import Revit
clr.ImportExtensions(Revit.Elements)
clr.ImportExtensions(Revit.GeometryConversion)

from System.Collections.Generic import List


phase = UnwrapElement(IN[1])

collector = FilteredElementCollector(doc)
levels = collector.OfClass(Level).ToElements()
	
leveldict2 = {}
for level in levels:
	leveldict2[math.ceil((level.Elevation+0.5)*100)/100] = level
	
collector2 = FilteredElementCollector(doc)
spaces = collector2.OfCategory(BuiltInCategory.OST_MEPSpaces).ToElements()

if isinstance(IN[0], list):
	rooms = UnwrapElement(IN[0])
else:
	rooms = [UnwrapElement(IN[0])]

spacedict = {}
for x in spaces:
	spacedict[x.Number] = x

roomdict = {}
for x in rooms:
	if x.Location != None:
		roomdict[x.Number] = x


spacenumbers = [x.Number for x in spaces]
roomnumbers = [x.Number for x in rooms if x.Location != None]
spaceset = set(spacenumbers)
roomset = set(roomnumbers)

newrooms = roomset.difference(spaceset)

newspaces = []
newrooms2 = []
failed = []

TransactionManager.Instance.EnsureInTransaction(doc)
for x in newrooms:
	room = roomdict[x]
	roomelev = math.ceil((room.Level.Elevation+0.5)*100)/100
	try:
		level = leveldict2[roomelev]
	except:
		failed.append("could not find a matching level for room: "+ x)
		continue
	
	try:
		newrooms2.append(room)
		loc = room.Location.Point
		newspace = doc.Create.NewSpace(level,phase,UV(loc.X,loc.Y))
		newspaces.append(newspace)
	except:
		failed.append("failed new space creation for room: "+ x)
TransactionManager.Instance.TransactionTaskDone()


newspaces2 = []
TransactionManager.Instance.EnsureInTransaction(doc)
for space,room in zip(newspaces,newrooms2):
	try:
		space.Number = room.Number
	except:
		failed.append("failed to set space number for space: " + space.Number)
	
	try:
		space.LimitOffset = room.LimitOffset
	except:
		failed.append("failed to set LimitOffset for space: " + space.Number)

	newspaces2.append(space.ToDSType(False))
TransactionManager.Instance.TransactionTaskDone()

#Assign your output to the OUT variable.
OUT = newspaces2,failed
# ----------------------------------------
code_block = CodeBlock(x=python_script) { x[0]; }
Spaces = Output(code_block)
code_block_2 = CodeBlock(x=python_script) { x[1]; }
Failed = Output(code_block_2)
