# Dynamo custom node SpaceCoordination delete redundant spaces.dyf (Dynamo 2.6.1.8786)
# category: MEPover.Revit.RoomsAndSpaces
# Will delete spaces for which no matching room number can be found in the given linked document

LinkDoc = Input(LinkDoc: var[]..[])
python_script = Python(IN[0]=LinkDoc)
# ---------- python_script.python (50 lines) ----------
import clr

clr.AddReference("RevitServices")
import RevitServices
from RevitServices.Persistence import DocumentManager
from RevitServices.Transactions import TransactionManager
doc = DocumentManager.Instance.CurrentDBDocument

clr.AddReference("RevitAPI")
import Autodesk
from Autodesk.Revit.DB import *

clr.AddReference("RevitNodes")
import Revit
clr.ImportExtensions(Revit.Elements)
clr.ImportExtensions(Revit.GeometryConversion)

from System.Collections.Generic import List

linkdoc = IN[0]
	
collector2 = FilteredElementCollector(doc)
spaces = collector2.OfCategory(BuiltInCategory.OST_MEPSpaces).ToElements()

collector3 = FilteredElementCollector(linkdoc)
rooms = collector3.OfCategory(BuiltInCategory.OST_Rooms).ToElements()

spacedict = {}
for x in spaces:
	spacedict[x.Number] = x


spacenumbers = [x.Number for x in spaces]
roomnumbers = [x.Number for x in rooms if x.Location != None]
spaceset = set(spacenumbers)
roomset = set(roomnumbers)

delete = spaceset.difference(roomset)

TransactionManager.Instance.EnsureInTransaction(doc)
for x in delete:
	space = spacedict[x]
	try:
		doc.Delete(space.Id)
	except:
		delete.discard(x)
TransactionManager.Instance.TransactionTaskDone()

#Assign your output to the OUT variable.
OUT = delete
# ----------------------------------------
Deleted_Spaces = Output(python_script)
