# Dynamo custom node Spaces place automatically for all levels.dyf (Dynamo 2.0.3.8810)
# category: MEPover.Revit.RoomsAndSpaces
# This node will attempt to create spaces automatically for every level

Phase = Input(Phase: var[]..[])
python_script = Python(IN[0]=Phase)
# ---------- python_script.python (52 lines) ----------
import clr

clr.AddReference("RevitServices")
import RevitServices
from RevitServices.Persistence import DocumentManager
from RevitServices.Transactions import TransactionManager
doc = DocumentManager.Instance.CurrentDBDocument

clr.AddReference("RevitAPI")
import Autodesk
from Autodesk.Revit.DB import *

clr.AddReference("RevitNodes")
import Revit
clr.ImportExtensions(Revit.Elements)
clr.ImportExtensions(Revit.GeometryConversion)

collector = FilteredElementCollector(doc)
levels = collector.OfClass(Level).ToElements()

phase = UnwrapElement(IN[0])
limitoffset = 8
listout = []
TransactionManager.Instance.EnsureInTransaction(doc)
for j,level in enumerate(levels):
	try:
		planTopology = doc.get_PlanTopology(level)
		rooms = []
		
		for i,plancircuit in enumerate(planTopology.Circuits):
			uv = plancircuit.GetPointInside()
			point = XYZ(uv.U,uv.V,level.Elevation)
			if doc.GetSpaceAtPoint(point,phase) != None:
				continue
	#		TransactionManager.Instance.EnsureInTransaction(doc)
			try:
				room = doc.Create.NewSpace(level,phase,uv)
				room.Name = "Name" + str(i)
				room.Number = str(j) + "." + str(i)
				room.LimitOffset = limitoffset
				rooms.append(room)
			except:
				listout.append("level2")
				continue
	#		TransactionManager.Instance.TransactionTaskDone()
		listout.append(rooms)
	except:
		continue
TransactionManager.Instance.TransactionTaskDone()


OUT = listout
# ----------------------------------------
Spaces = Output(python_script)
