# Dynamo custom node Tag Get Location.dyf (Dynamo 2.6.1.8786)
# category: MEPover.Revit.Tags
# Returns the location of the tags

tags = Input(tags: var[]..[])
python_script = Python(IN[0]=tags)
# ---------- python_script.python (26 lines) ----------
import clr

clr.AddReference("RevitServices")
import RevitServices
from RevitServices.Persistence import DocumentManager
doc =  DocumentManager.Instance.CurrentDBDocument

clr.AddReference("RevitNodes")
import Revit
clr.ImportExtensions(Revit.Elements)
clr.ImportExtensions(Revit.GeometryConversion)

if isinstance(IN[0], list):
	tags = UnwrapElement(IN[0])
else:
	tags = [UnwrapElement(IN[0])]

listout = []


for x in tags:
	loc = x.TagHeadPosition.ToPoint()
	listout.append(loc)


OUT = listout
# ----------------------------------------
points = Output(python_script)
