# Dynamo custom node Tee.By3MEPCurves.dyf (Dynamo 2.6.1.8786)
# category: MEPover.Revit.Elements
# Creates a new Tee fitting for the 3 input MEP curves (conduit, cable tray, duct or pipe). Only works with a perpendicular branch MEPCurve

Main_MEPCurve = Input(Main_MEPCurve: var[]..[])
Main_MEPCurve_2 = Input(Main_MEPCurve: var[]..[])
Branch_MEPCurve = Input(Branch_MEPCurve: var[]..[])
python_script = Python(IN[0]=Main_MEPCurve, IN[1]=Main_MEPCurve_2, IN[2]=Branch_MEPCurve)
# ---------- python_script.python (68 lines) ----------
import clr

clr.AddReference("RevitServices")
import RevitServices
from RevitServices.Persistence import DocumentManager
from RevitServices.Transactions import TransactionManager
doc = DocumentManager.Instance.CurrentDBDocument

clr.AddReference("RevitAPI")
from Autodesk.Revit.DB import *

clr.AddReference("RevitNodes")
import Revit
clr.ImportExtensions(Revit.Elements)
clr.ImportExtensions(Revit.GeometryConversion)

if isinstance(IN[0], list):
	pipe1 = UnwrapElement(IN[0])
else:
	pipe1 = [UnwrapElement(IN[0])]
if isinstance(IN[1], list):
	pipe2 = UnwrapElement(IN[1])
else:
	pipe2 = [UnwrapElement(IN[1])]
if isinstance(IN[2], list):
	pipe3 = UnwrapElement(IN[2])
else:
	pipe3 = [UnwrapElement(IN[2])]

def closest_connectors(pipe1, pipe2,pipe3):
	conn1 = pipe1.ConnectorManager.Connectors
	conn2 = pipe2.ConnectorManager.Connectors
	conn3 = pipe3.ConnectorManager.Connectors
	
	dist1 = 100000000
	dist2 = 100000000
	connset = []
	for c in conn1:
		for d in conn2:
			conndist = c.Origin.DistanceTo(d.Origin)
			if conndist < dist1:
				dist1 = conndist
				c1 = c
				d1 = d
		for e in conn3:
			conndist = c.Origin.DistanceTo(e.Origin)
			if conndist < dist2:
				dist2 = conndist
				e1 = e
		connset = [c1,d1,e1]
	return connset

	
fittings = []
TransactionManager.Instance.EnsureInTransaction(doc)
for p1,p2,p3 in zip(pipe1,pipe2,pipe3):
	connectors = closest_connectors(p1,p2,p3)
	try:
		fitting = doc.Create.NewTeeFitting(connectors[0],connectors[1],connectors[2])
		fittings.append(fitting.ToDSType(False))
	except:
		fittings.append(None)
		
TransactionManager.Instance.TransactionTaskDone()

			

OUT = fittings
# ----------------------------------------
Tee = Output(python_script)
