# Dynamo custom node Zone.AddSpaces.dyf (Dynamo 2.6.1.8786)
# category: MEPover.Revit.RoomsAndSpaces
# Will add the spaces to zone

zone = Input(zone: var[]..[])
Spaces = Input(Spaces: var[]..[])
python_script = Python(IN[0]=zone, IN[1]=Spaces)
# ---------- python_script.python (46 lines) ----------
import clr

clr.AddReference("RevitServices")
import RevitServices
from RevitServices.Persistence import DocumentManager
from RevitServices.Transactions import TransactionManager
doc = DocumentManager.Instance.CurrentDBDocument

clr.AddReference("RevitAPI")
import Autodesk
from Autodesk.Revit.DB import *

clr.AddReference("RevitNodes")
import Revit
clr.ImportExtensions(Revit.Elements)
clr.ImportExtensions(Revit.GeometryConversion)


def AddToZone(zone,spaces):
	TransactionManager.Instance.EnsureInTransaction(doc)
	if hasattr(spaces, "__iter__"):		
		for space in spaces:
			try:
				spaceset = Mechanical.SpaceSet()
				spaceset.Insert(space)
				zone.AddSpaces(spaceset)				
			except:
				pass
	else:
		try:
			spaceset = Mechanical.SpaceSet()
			spaceset.Insert(space)
			zone.AddSpaces(spaceset)
		except:
			pass
	TransactionManager.Instance.TransactionTaskDone()
	return zone

listout = []
if isinstance(IN[0], list):
	for i,zone in enumerate(UnwrapElement(IN[0])):
		listout.append(AddToZone(zone,UnwrapElement(IN[1])[i]))
else:
	listout.append(AddToZone(UnwrapElement(IN[0]),UnwrapElement(IN[1])))

OUT = listout
# ----------------------------------------
Zone = Output(python_script)
