# Dynamo custom node Zone.Spaces.dyf (Dynamo 2.6.1.8786)
# category: MEPover.Revit.RoomsAndSpaces
# Returns the spaces that are assigned to the Zone

zone = Input(zone: var[]..[])
python = Python(IN[0]=zone)
# ---------- python.python (41 lines) ----------
import clr

clr.AddReference("RevitServices")
import RevitServices
from RevitServices.Persistence import DocumentManager
from RevitServices.Transactions import TransactionManager
doc = DocumentManager.Instance.CurrentDBDocument

clr.AddReference("RevitAPI")
import Autodesk
from Autodesk.Revit.DB import *

clr.AddReference("RevitNodes")
import Revit
clr.ImportExtensions(Revit.Elements)
clr.ImportExtensions(Revit.GeometryConversion)

#Many thanks to Konrad K Sobon for his awesome ProcessList function!
def Unwrap(item):
	return UnwrapElement(item)

def ProcessList(_func, _list):
    return map( lambda x: ProcessList(_func, x) if type(x)==list else _func(x), _list )

if isinstance(IN[0], list):
	zones = ProcessList(Unwrap, IN[0])
else:
	zones = [Unwrap(IN[0])]
	
	
def getSpaces(zone):
	try:
		spaces = zone.Spaces
		return [x.ToDSType(True) for x in spaces]
	except:
		return None

			
#Assign your output to the OUT variable.

OUT = ProcessList(getSpaces, zones)
# ----------------------------------------
Spaces = Output(python)
