# Dynamo graph Copy parameter values.dyn "Parameter kopieren" (Dynamo 2.12.1.8246)

include_elements_in_groups = BoolSelector(true)
code_block = CodeBlock()
# ---------- code_block.designscript (16 lines) ----------
["Cable Trays",
"Cable Tray Fittings",
"Communication Devices",
"Conduits",
"Conduit Fittings",
"Data Devices",
"Electrical Equipment",
"Electrical Fixtures",
"Fire Alarm Devices",
"Generic Models",
"Lighting Fixtures",
"Lighting Devices",
"Nurse Call Devices",
"Security Devices",
"Specialty Equipment",
"Telephone Devices"];
# ----------------------------------------
byName = Category.ByName(name=code_block)
python_current_selection = Python()  # IronPython2; unwired: IN[0]
# ---------- python_current_selection.python (21 lines) ----------
#Copyright(c) 2016, Dimitar Venkov
# @5devene, dimitar.ven@gmail.com

import clr

clr.AddReference("RevitNodes")
import Revit
clr.ImportExtensions(Revit.Elements)

clr.AddReference("RevitServices")
import RevitServices
from RevitServices.Persistence import DocumentManager
doc = DocumentManager.Instance.CurrentDBDocument
uidoc = DocumentManager.Instance.CurrentUIApplication.ActiveUIDocument

def output1(l1):
	if len(l1) == 1: return l1[0]
	else: return l1

selid = uidoc.Selection.GetElementIds()
OUT = output1([doc.GetElement(id).ToDSType(True) for id in selid])
# ----------------------------------------
python_current_selection_get_all = Python(IN[0]=byName, IN[1]=python_current_selection)  # IronPython2
# ---------- python_current_selection_get_all.python (38 lines) ----------
import clr
clr.AddReference('RevitAPI')
from Autodesk.Revit.DB import *

clr.AddReference("RevitNodes")
import Revit
clr.ImportExtensions(Revit.Elements)
clr.ImportExtensions(Revit.GeometryConversion)

clr.AddReference("RevitServices")
import RevitServices
from RevitServices.Persistence import DocumentManager

doc = DocumentManager.Instance.CurrentDBDocument

view = doc.ActiveView
if isinstance(IN[0], list):
	category = UnwrapElement(IN[0])
else:
	category = [UnwrapElement(IN[0])]
current = UnwrapElement(IN[1])


if isinstance(current, FamilyInstance):
	listout = current
else:
	if len(current) > 0:
		listout = current
	else:
		listout = []
		for c in category:
			collector = FilteredElementCollector(doc,view.Id)
			elements = collector.OfCategoryId(c.Id).ToElements()
			listout.extend(elements)



OUT = listout
# ----------------------------------------
parameter_1 = StringInput("Elevation from Level")  # graph input
getParameterValueByName = Element.GetParameterValueByName(element=python_current_selection_get_all, parameterName=parameter_1)
parameter_2 = StringInput("Ass. Level Elevation Center")  # graph input
getParameterValueByName_2 = Element.GetParameterValueByName(element=python_current_selection_get_all, parameterName=parameter_2)
code_block_2 = CodeBlock(x=getParameterValueByName, y=getParameterValueByName_2) { x == y; }

# group: Filter out elements that already have the same value
filterByBoolMask = List.FilterByBoolMask(list=python_current_selection_get_all, mask=code_block_2)
filterByBoolMask_2 = List.FilterByBoolMask(list=getParameterValueByName, mask=code_block_2)

python_get_groups = Python(IN[0]=filterByBoolMask.out)  # IronPython2
# ---------- python_get_groups.python (12 lines) ----------
import clr
clr.AddReference('RevitAPI')
from Autodesk.Revit.DB import *

def GetGroup(item):
	if hasattr(item, "GroupId"): return item.Document.GetElement(item.GroupId)
	else: return None

items = UnwrapElement(IN[0])

if isinstance(IN[0], list): OUT = [GetGroup(x) for x in items]
else: OUT = GetGroup(items)
# ----------------------------------------
isNull = Object.IsNull(object=python_get_groups)

# group: Filter out elements in groups
filterByBoolMask_3 = List.FilterByBoolMask(list=filterByBoolMask.out, mask=isNull)
filterByBoolMask_4 = List.FilterByBoolMask(list=filterByBoolMask_2.out, mask=isNull)

if_ = RefactoredIf(test=include_elements_in_groups, true=filterByBoolMask.out, false=filterByBoolMask_3.in)
if_2 = RefactoredIf(test=include_elements_in_groups, true=filterByBoolMask_2.out, false=filterByBoolMask_4.in)
setParameterByName = Element.SetParameterByName(element=if_, parameterName=parameter_2, value=if_2)
