# Dynamo graph FilterNumeric series.dyn (Dynamo 2.13.1.3887)
# packages: MEPover 2022.10.30

code_block = CodeBlock { 0; }
code_block_2 = CodeBlock { "Ground Bus"; }
python_filterintegerequals = Python(IN[0]=code_block, IN[1]=code_block_2)  # IronPython2
# ---------- python_filterintegerequals.python (109 lines) ----------
import clr
import System

clr.AddReference("RevitServices")
import RevitServices
from RevitServices.Persistence import DocumentManager
from RevitServices.Transactions import TransactionManager
doc = DocumentManager.Instance.CurrentDBDocument

clr.AddReference("RevitAPI")
import Autodesk
from Autodesk.Revit.DB import *

clr.AddReference("RevitNodes")
import Revit
clr.ImportExtensions(Revit.Elements)
clr.ImportExtensions(Revit.GeometryConversion)

from System.Collections.Generic import List
val = IN[0]
search = IN[1]

bips = System.Enum.GetValues(BuiltInParameter)

bm = doc.ParameterBindings
bmlist = bm.ForwardIterator()
paramId = None
testout = []
while bmlist.MoveNext():
	binddef = bmlist.Key
	testout.append(binddef.Name)
	if binddef.Name == search:
		paramId = binddef.Id
		break

param = None
if paramId == None:
	biplist = []
	for bip in bips:
		try:
			name = LabelUtils.GetLabelFor(bip)
		except:
			continue
		if name == search:
			biplist.append(bip)


sharedparamrule = SharedParameterApplicableRule(search)
evaluator = FilterNumericEquals()

parameter = None
if paramId == None and len(biplist) == 0:
	coll = FilteredElementCollector(doc)
	sharedparams = coll.OfClass(ParameterElement)
	
	for param in sharedparams:
		name = param.GetDefinition().Name
		if name == search:
			parameter = param
	
	if parameter != None:
		ruleslist = List[FilterRule]()
		provider = ParameterValueProvider(parameter.Id)
		filterrule = FilterIntegerRule(provider, evaluator, val)
		ruleslist.Add(filterrule)
		ruleslist.Add(sharedparamrule)
		paramFilter = ElementParameterFilter(ruleslist)
		collector = FilteredElementCollector(doc)
		collector.OfClass(FamilyInstance).WherePasses(paramFilter)
		
		collector2 = FilteredElementCollector(doc)
		collector2.OfClass(HostObject).WherePasses(paramFilter)
		collector2.UnionWith(collector)

elif paramId == None:
	filterList = List[ElementFilter]()
	for param in biplist:
		provider = ParameterValueProvider(ElementId(param))
		filterrule = FilterIntegerRule(provider, evaluator, val)
		paramFilter = ElementParameterFilter(filterrule)
		filterList.Add(paramFilter)
			
	orFilter = LogicalOrFilter(filterList)
	collector = FilteredElementCollector(doc)
	collector.OfClass(FamilyInstance).WherePasses(orFilter)
	
	collector2 = FilteredElementCollector(doc)
	collector2.OfClass(HostObject).WherePasses(orFilter)
	collector2.UnionWith(collector)
else:
	ruleslist = List[FilterRule]()
	provider = ParameterValueProvider(paramId)
	filterrule = FilterIntegerRule(provider, evaluator, val)
	ruleslist.Add(filterrule)
	ruleslist.Add(sharedparamrule)
	paramFilter = ElementParameterFilter(ruleslist)
	collector = FilteredElementCollector(doc)
	collector.OfClass(FamilyInstance).WherePasses(paramFilter)
	
	collector2 = FilteredElementCollector(doc)
	collector2.OfClass(HostObject).WherePasses(paramFilter)
	collector2.UnionWith(collector)


if parameter == None and paramId == None and len(biplist) == 0:
	OUT = "Does not work with non-shared family parameters"
else:
	elements = collector2.ToElements()
	OUT = elements
# ----------------------------------------
python_filterintegergreaterthan = Python(IN[0]=code_block, IN[1]=code_block_2)  # IronPython2
# ---------- python_filterintegergreaterthan.python (109 lines) ----------
import clr
import System

clr.AddReference("RevitServices")
import RevitServices
from RevitServices.Persistence import DocumentManager
from RevitServices.Transactions import TransactionManager
doc = DocumentManager.Instance.CurrentDBDocument

clr.AddReference("RevitAPI")
import Autodesk
from Autodesk.Revit.DB import *

clr.AddReference("RevitNodes")
import Revit
clr.ImportExtensions(Revit.Elements)
clr.ImportExtensions(Revit.GeometryConversion)

from System.Collections.Generic import List
val = IN[0]
search = IN[1]

bips = System.Enum.GetValues(BuiltInParameter)

bm = doc.ParameterBindings
bmlist = bm.ForwardIterator()
paramId = None
testout = []
while bmlist.MoveNext():
	binddef = bmlist.Key
	testout.append(binddef.Name)
	if binddef.Name == search:
		paramId = binddef.Id
		break

param = None
if paramId == None:
	biplist = []
	for bip in bips:
		try:
			name = LabelUtils.GetLabelFor(bip)
		except:
			continue
		if name == search:
			biplist.append(bip)


sharedparamrule = SharedParameterApplicableRule(search)
evaluator = FilterNumericGreater()

parameter = None
if paramId == None and len(biplist) == 0:
	coll = FilteredElementCollector(doc)
	sharedparams = coll.OfClass(ParameterElement)
	
	for param in sharedparams:
		name = param.GetDefinition().Name
		if name == search:
			parameter = param
	
	if parameter != None:
		ruleslist = List[FilterRule]()
		provider = ParameterValueProvider(parameter.Id)
		filterrule = FilterIntegerRule(provider, evaluator, val)
		ruleslist.Add(filterrule)
		ruleslist.Add(sharedparamrule)
		paramFilter = ElementParameterFilter(ruleslist)
		collector = FilteredElementCollector(doc)
		collector.OfClass(FamilyInstance).WherePasses(paramFilter)
		
		collector2 = FilteredElementCollector(doc)
		collector2.OfClass(HostObject).WherePasses(paramFilter)
		collector2.UnionWith(collector)

elif paramId == None:
	filterList = List[ElementFilter]()
	for param in biplist:
		provider = ParameterValueProvider(ElementId(param))
		filterrule = FilterIntegerRule(provider, evaluator, val)
		paramFilter = ElementParameterFilter(filterrule)
		filterList.Add(paramFilter)
			
	orFilter = LogicalOrFilter(filterList)
	collector = FilteredElementCollector(doc)
	collector.OfClass(FamilyInstance).WherePasses(orFilter)
	
	collector2 = FilteredElementCollector(doc)
	collector2.OfClass(HostObject).WherePasses(orFilter)
	collector2.UnionWith(collector)
else:
	ruleslist = List[FilterRule]()
	provider = ParameterValueProvider(paramId)
	filterrule = FilterIntegerRule(provider, evaluator, val)
	ruleslist.Add(filterrule)
	ruleslist.Add(sharedparamrule)
	paramFilter = ElementParameterFilter(ruleslist)
	collector = FilteredElementCollector(doc)
	collector.OfClass(FamilyInstance).WherePasses(paramFilter)
	
	collector2 = FilteredElementCollector(doc)
	collector2.OfClass(HostObject).WherePasses(paramFilter)
	collector2.UnionWith(collector)


if parameter == None and paramId == None and len(biplist) == 0:
	OUT = "Does not work with non-shared family parameters"
else:
	elements = collector2.ToElements()
	OUT = elements
# ----------------------------------------
code_block_3 = CodeBlock { 2; }
code_block_4 = CodeBlock { "Offset from Host"; }
python_filternumericlessthan = Python(IN[0]=code_block_3, IN[1]=code_block_4)  # IronPython2
# ---------- python_filternumericlessthan.python (128 lines) ----------
import clr
import System

clr.AddReference("RevitServices")
import RevitServices
from RevitServices.Persistence import DocumentManager
from RevitServices.Transactions import TransactionManager
doc = DocumentManager.Instance.CurrentDBDocument

clr.AddReference("RevitAPI")
import Autodesk
from Autodesk.Revit.DB import *

clr.AddReference("RevitNodes")
import Revit
clr.ImportExtensions(Revit.Elements)
clr.ImportExtensions(Revit.GeometryConversion)

from System.Collections.Generic import List
val = IN[0]
search = IN[1]

bips = System.Enum.GetValues(BuiltInParameter)

bm = doc.ParameterBindings
bmlist = bm.ForwardIterator()
paramId = None
testout = []
while bmlist.MoveNext():
	binddef = bmlist.Key
	testout.append(binddef.Name)
	if binddef.Name == search:
		paramId = binddef.Id
		break

param = None
if paramId == None:
	biplist = []
	for bip in bips:
		try:
			name = LabelUtils.GetLabelFor(bip)
		except:
			continue
		if name == search:
			biplist.append(bip)


sharedparamrule = SharedParameterApplicableRule(search)
evaluator = FilterNumericLess()

parameter = None
if paramId == None and len(biplist) == 0:
	coll = FilteredElementCollector(doc)
	sharedparams = coll.OfClass(ParameterElement)
	
	for param in sharedparams:
		name = param.GetDefinition().Name
		if name == search:
			parameter = param
	
	if parameter != None:
		is_int = parameter.StorageType == StorageType.Integer
		ruleslist = List[FilterRule]()
		provider = ParameterValueProvider(parameter.Id)		
		if is_int:
			filterrule = FilterIntegerRule(provider, evaluator, val)
		else:
			ProjectUnits = parameter.GetUnitTypeId()
			val = UnitUtils.ConvertFromInternalUnits(val,ProjectUnits)
			filterrule = FilterDoubleRule(provider, evaluator, val, 10e-10)
		ruleslist.Add(filterrule)
		ruleslist.Add(sharedparamrule)
		paramFilter = ElementParameterFilter(ruleslist)
		collector = FilteredElementCollector(doc)
		collector.OfClass(FamilyInstance).WherePasses(paramFilter)
		
		collector2 = FilteredElementCollector(doc)
		collector2.OfClass(HostObject).WherePasses(paramFilter)
		collector2.UnionWith(collector)

elif paramId == None:
	filterList = List[ElementFilter]()
	for param in biplist:
		provider = ParameterValueProvider(ElementId(param))
		is_int = doc.get_TypeOfStorage(param) == StorageType.Integer
		if is_int:
			filterrule = FilterIntegerRule(provider, evaluator, val)
		else:
			ProjectUnits = param.GetUnitTypeId()
			val = UnitUtils.ConvertFromInternalUnits(val,ProjectUnits)
			filterrule = FilterDoubleRule(provider, evaluator, val, 10e-10)
		paramFilter = ElementParameterFilter(filterrule)
		filterList.Add(paramFilter)
			
	orFilter = LogicalOrFilter(filterList)
	collector = FilteredElementCollector(doc)
	collector.OfClass(FamilyInstance).WherePasses(orFilter)
	
	collector2 = FilteredElementCollector(doc)
	collector2.OfClass(HostObject).WherePasses(orFilter)
	collector2.UnionWith(collector)
else:
	ruleslist = List[FilterRule]()
	provider = ParameterValueProvider(paramId)
	param = doc.GetElement(paramId)
	is_int = param.StorageType == StorageType.Integer
	if is_int:
		filterrule = FilterIntegerRule(provider, evaluator, val)
	else:
		ProjectUnits = param.GetUnitTypeId()
		val = UnitUtils.ConvertFromInternalUnits(val,ProjectUnits)
		filterrule = FilterDoubleRule(provider, evaluator, val, 10e-10)
	ruleslist.Add(filterrule)
	ruleslist.Add(sharedparamrule)
	paramFilter = ElementParameterFilter(ruleslist)
	collector = FilteredElementCollector(doc)
	collector.OfClass(FamilyInstance).WherePasses(paramFilter)
	
	collector2 = FilteredElementCollector(doc)
	collector2.OfClass(HostObject).WherePasses(paramFilter)
	collector2.UnionWith(collector)


if parameter == None and paramId == None and len(biplist) == 0:
	OUT = "Does not work with non-shared family parameters"
else:
	elements = collector2.ToElements()
	OUT = elements
# ----------------------------------------
code_block_5 = CodeBlock { "Max Number of Circuits"; }
python_filterintegerlessthan = Python(IN[0]=code_block, IN[1]=code_block_5)  # IronPython2
# ---------- python_filterintegerlessthan.python (109 lines) ----------
import clr
import System

clr.AddReference("RevitServices")
import RevitServices
from RevitServices.Persistence import DocumentManager
from RevitServices.Transactions import TransactionManager
doc = DocumentManager.Instance.CurrentDBDocument

clr.AddReference("RevitAPI")
import Autodesk
from Autodesk.Revit.DB import *

clr.AddReference("RevitNodes")
import Revit
clr.ImportExtensions(Revit.Elements)
clr.ImportExtensions(Revit.GeometryConversion)

from System.Collections.Generic import List
val = IN[0]
search = IN[1]

bips = System.Enum.GetValues(BuiltInParameter)

bm = doc.ParameterBindings
bmlist = bm.ForwardIterator()
paramId = None
testout = []
while bmlist.MoveNext():
	binddef = bmlist.Key
	testout.append(binddef.Name)
	if binddef.Name == search:
		paramId = binddef.Id
		break

param = None
if paramId == None:
	biplist = []
	for bip in bips:
		try:
			name = LabelUtils.GetLabelFor(bip)
		except:
			continue
		if name == search:
			biplist.append(bip)


sharedparamrule = SharedParameterApplicableRule(search)
evaluator = FilterNumericLess()

parameter = None
if paramId == None and len(biplist) == 0:
	coll = FilteredElementCollector(doc)
	sharedparams = coll.OfClass(ParameterElement)
	
	for param in sharedparams:
		name = param.GetDefinition().Name
		if name == search:
			parameter = param
	
	if parameter != None:
		ruleslist = List[FilterRule]()
		provider = ParameterValueProvider(parameter.Id)
		filterrule = FilterIntegerRule(provider, evaluator, val)
		ruleslist.Add(filterrule)
		ruleslist.Add(sharedparamrule)
		paramFilter = ElementParameterFilter(ruleslist)
		collector = FilteredElementCollector(doc)
		collector.OfClass(FamilyInstance).WherePasses(paramFilter)
		
		collector2 = FilteredElementCollector(doc)
		collector2.OfClass(HostObject).WherePasses(paramFilter)
		collector2.UnionWith(collector)

elif paramId == None:
	filterList = List[ElementFilter]()
	for param in biplist:
		provider = ParameterValueProvider(ElementId(param))
		filterrule = FilterIntegerRule(provider, evaluator, val)
		paramFilter = ElementParameterFilter(filterrule)
		filterList.Add(paramFilter)
			
	orFilter = LogicalOrFilter(filterList)
	collector = FilteredElementCollector(doc)
	collector.OfClass(FamilyInstance).WherePasses(orFilter)
	
	collector2 = FilteredElementCollector(doc)
	collector2.OfClass(HostObject).WherePasses(orFilter)
	collector2.UnionWith(collector)
else:
	ruleslist = List[FilterRule]()
	provider = ParameterValueProvider(paramId)
	filterrule = FilterIntegerRule(provider, evaluator, val)
	ruleslist.Add(filterrule)
	ruleslist.Add(sharedparamrule)
	paramFilter = ElementParameterFilter(ruleslist)
	collector = FilteredElementCollector(doc)
	collector.OfClass(FamilyInstance).WherePasses(paramFilter)
	
	collector2 = FilteredElementCollector(doc)
	collector2.OfClass(HostObject).WherePasses(paramFilter)
	collector2.UnionWith(collector)


if parameter == None and paramId == None and len(biplist) == 0:
	OUT = "Does not work with non-shared family parameters"
else:
	elements = collector2.ToElements()
	OUT = elements
# ----------------------------------------
views = Views("00 - C00_Algemeen")
all__linked__elements_in_view = Custom[All_(Linked)_Elements_In_View](view=views)  # package MEPover; This node will return a dictionary with all visible element per document from the given view, including elements from linked files.
