# Dynamo graph Get Surrounding elements with intersect filter.dyn (Dynamo 2.12.1.8246)
# packages: MEPover 2024.9.25, spring nodes 210.1.1

code_block = CodeBlock { 1; }
ꟿ_document_activeview = Custom[ꟿ Document.ActiveView](refresh=code_block)  # package spring nodes; Selects the current document's active view. Supports more view types than the built-in option. Will be depreciated once the bult in node works with all plan types.
all__linked__elements_in_view = Custom[All_(Linked)_Elements_In_View](view=ꟿ_document_activeview)  # package MEPover; This node will return a dictionary with all visible element per document from the given view, including elements from linked files.
code_block_2 = CodeBlock(x=all__linked__elements_in_view.documents, y=all__linked__elements_in_view.elements) { x[1]; y[1]; }
ꟿ_collect_currentselection = Custom[ꟿ Collect.CurrentSelection]()  # package spring nodes; Gets the currently selected elements. Connect a boolean switch to refresh the selection.
python_script = Python(IN[0]=code_block_2.out0, IN[1]=code_block_2.out1, IN[2]=ꟿ_collect_currentselection)  # IronPython2
# ---------- python_script.python (56 lines) ----------
import clr

clr.AddReference("RevitServices")
import RevitServices
from RevitServices.Persistence import DocumentManager
from RevitServices.Transactions import TransactionManager
doc = DocumentManager.Instance.CurrentDBDocument
uidoc = DocumentManager.Instance.CurrentUIApplication.ActiveUIDocument

clr.AddReference("RevitAPI")
import Autodesk
from Autodesk.Revit.DB import *

clr.AddReference("RevitNodes")
import Revit
clr.ImportExtensions(Revit.Elements)
clr.ImportExtensions(Revit.GeometryConversion)

from System.Collections.Generic import List

docname = UnwrapElement(IN[0])
elements = UnwrapElement(IN[1])
voidFams = UnwrapElement(IN[2])


linkinstances = FilteredElementCollector(doc).OfClass(RevitLinkInstance)
linkdoc = None
linkinstance = None
for link in linkinstances:
	ldoc = link.GetLinkDocument()
	if ldoc == None:
		continue
	if ldoc.Title == docname:
		linkdoc = ldoc
		linkinstance = link
		
		
linkTransform = linkinstance.GetTransform()

ids = List[ElementId]()
#linkboxes = []
#for element in elements:
#	ids.Add(element.Id)
#	linkboxes.append(element.get_BoundingBox(None).ToProtoType())
superCollector = FilteredElementCollector(linkdoc, ids)

for voidFam in voidFams:
	voidFamBbox = voidFam.get_BoundingBox(doc.ActiveView)
	minP = linkTransform.Inverse.OfPoint(voidFamBbox.Min)
	maxP = linkTransform.Inverse.OfPoint(voidFamBbox.Max)
	outlineSuper = Outline(minP, maxP)
	bboxFilterSuper = BoundingBoxIntersectsFilter(outlineSuper)
	listout = superCollector.WherePasses(bboxFilterSuper).ToElements()


OUT = listout
# ----------------------------------------
