# Dynamo graph Get all elements in current view and links.dyn (Dynamo 2.13.1.3887)
# packages: spring nodes 210.1.1

boolean = BoolSelector(true)
python_script = Python(IN[0]=boolean)  # IronPython2; frozen
# ---------- python_script.python (222 lines) ----------
import clr

clr.AddReference("RevitServices")
import RevitServices
from RevitServices.Persistence import DocumentManager
from RevitServices.Transactions import TransactionManager
doc = DocumentManager.Instance.CurrentDBDocument
uidoc = DocumentManager.Instance.CurrentUIApplication.ActiveUIDocument

clr.AddReference("RevitAPI")
import Autodesk
from Autodesk.Revit.DB import *

clr.AddReference("RevitNodes")
import Revit
clr.ImportExtensions(Revit.Elements)
clr.ImportExtensions(Revit.GeometryConversion)

from System.Collections.Generic import List
	
class ElementCollector:
    def __init__(self, uidoc):
        self._uiDocument = uidoc
        self._app = uidoc.Application.Application
        self._parentDocument = uidoc.Document
        self._activeView = self._parentDocument.ActiveView
        

    def GetVisibleElements(self):
        self.context = VisibleElementContext(self._parentDocument)
        exp = CustomExporter(self._parentDocument, self.context)
        views = List[ElementId]([self._activeView.Id])
        exp.Export(views)
        return self.context.Elements
        
    def GetVisibleElements2D(self):
        self.context2D = VisibleElementContext2D(self._parentDocument)
        exp = CustomExporter(self._parentDocument, self.context2D)
        views = List[ElementId]([self._activeView.Id])
        exp.Export(views)
        return self.context2D.Elements


class VisibleElementContext2D(IExportContext2D):
    def __init__(self, doc):
        self.ParentDocument = doc
        self.CurrentDocument = doc
        self.Documents = [doc]
        self.Elements = []
        self.ElementIds = []
        self.DocMap = {}
        self.DocMap[self.CurrentDocument.Title] = []

    def Finish(self):
        pass

    def IsCanceled(self):
        return False

    def OnCurve(self, node):
        return RenderNodeAction.Skip

    def OnElementBegin(self, elementId):
        return RenderNodeAction.Skip

    def OnElementBegin2D(self, node):
        self.ElementIds.append(node.ElementId)
        elem = self.CurrentDocument.GetElement(node.ElementId)
        self.Elements.append(elem)
        self.DocMap[self.CurrentDocument.Title].append(elem)
        return RenderNodeAction.Proceed

    def OnElementEnd(self, elementId):
        pass

    def OnElementEnd2D(self, node):
        pass

    def OnFaceBegin(self, node):
        return RenderNodeAction.Skip

    def OnFaceEdge2D(self, node):
        return RenderNodeAction.Skip

    def OnFaceEnd(self, node):
        pass

    def OnFaceSilhouette2D(self, node):
        return RenderNodeAction.Skip

    def OnInstanceBegin(self, node):
        return RenderNodeAction.Proceed

    def OnInstanceEnd(self, node):
        pass

    def OnLight(self, node):
        pass

    def OnLineSegment(self, segment):
        pass

    def OnLinkBegin(self, node):
        doc = node.GetDocument()
        self.Documents.append(doc)
        self.CurrentDocument = doc
        if self.CurrentDocument.Title not in self.DocMap:
        	self.DocMap[self.CurrentDocument.Title] = []
        return RenderNodeAction.Proceed

    def OnLinkEnd(self, node):
        self.CurrentDocument = self.ParentDocument

    def OnMaterial(self, node):
        raise NotImplementedError

    def OnPolyline(self, node):
        return RenderNodeAction.Skip

    def OnPolylineSegments(self, segments):
        pass

    def OnPolymesh(self, node):
        pass

    def OnRPC(self, node):
        pass

    def OnText(self, node):
        pass

    def OnViewBegin(self, node):
        return RenderNodeAction.Proceed

    def OnViewEnd(self, elementId):
        pass

    def Start(self):
        return True
        
class VisibleElementContext(IExportContext):
    def __init__(self, doc):
        self.ParentDocument = doc
        self.CurrentDocument = doc
        self.Documents = [doc]
        self.Elements = []
        self.ElementIds = []
        self.DocMap = {}
        self.DocMap[self.CurrentDocument.Title] = []

    def Start(self):
        return True

    def Finish(self):
        pass

    def IsCanceled(self):
        return False

    def OnViewBegin(self, node):
        return RenderNodeAction.Proceed

    def OnViewEnd(self, elementId):
        pass

    def OnElementBegin(self, elementId):
        self.ElementIds.append(elementId)
        elem = self.CurrentDocument.GetElement(elementId)
        self.Elements.append(elem)
        self.DocMap[self.CurrentDocument.Title].append(elem)
        return RenderNodeAction.Proceed

    def OnElementEnd(self, elementId):
        pass

    def OnInstanceBegin(self, node):
        return RenderNodeAction.Proceed

    def OnInstanceEnd(self, node):
        pass

    def OnLinkBegin(self, node):
        doc = node.GetDocument()
        self.Documents.append(doc)
        self.CurrentDocument = doc
        if self.CurrentDocument.Title not in self.DocMap:
        	self.DocMap[self.CurrentDocument.Title] = []
        return RenderNodeAction.Proceed

    def OnLinkEnd(self, node):
        self.CurrentDocument = self.ParentDocument

    def OnFaceBegin(self, node):
        return RenderNodeAction.Skip

    def OnFaceEnd(self, node):
        pass

    def OnRPC(self, node):
        pass

    def OnLight(self, node):
        pass

    def OnMaterial(self, node):
        pass

    def OnPolymesh(self, node):
        pass


collector = ElementCollector(uidoc)
listout = None
viewtype = doc.ActiveView.ViewType
if viewtype == ViewType.ThreeD:
	elements = collector.GetVisibleElements()
	listout = collector.context.DocMap
elif viewtype == ViewType.FloorPlan or viewtype == ViewType.Section or viewtype == ViewType.Elevation or viewtype == ViewType.CeilingPlan or viewtype == ViewType.AreaPlan or viewtype == ViewType.EngineeringPlan:
	elements = collector.GetVisibleElements2D()
	listout = collector.context2D.DocMap

OUT = doc.ActiveView.Name, listout #elements, [x.GetType() for x in elements if x is not None]
# ----------------------------------------
code_block = CodeBlock(x=python_script) { x[1]; }
uniqueItems = List.UniqueItems(list=code_block)
# note: https://github.com/DynamoDS/Dynamo/wiki/Work-in-progress-to-improve-Python-3-support
python3_inheritance_does_not = Python(IN[0]=boolean)  # "Python3 inheritance does not work"; CPython3; frozen
# ---------- python3_inheritance_does_not.python (221 lines) ----------
import clr

clr.AddReference("RevitServices")
import RevitServices
from RevitServices.Persistence import DocumentManager
from RevitServices.Transactions import TransactionManager
doc = DocumentManager.Instance.CurrentDBDocument
uidoc = DocumentManager.Instance.CurrentUIApplication.ActiveUIDocument

clr.AddReference("RevitAPI")
import Autodesk
from Autodesk.Revit.DB import *

clr.AddReference("RevitNodes")
import Revit
clr.ImportExtensions(Revit.Elements)
clr.ImportExtensions(Revit.GeometryConversion)

from System.Collections.Generic import List

class ElementCollector:
    def __init__(self, uidoc):
        self._uiDocument = uidoc
        self._app = uidoc.Application.Application
        self._parentDocument = uidoc.Document
        self._activeView = self._parentDocument.ActiveView


    def GetVisibleElements(self):
        self.context = VisibleElementContext(self._parentDocument)
        exp = CustomExporter(self._parentDocument, self.context)
        views = List[ElementId]([self._activeView.Id])
        exp.Export(views)
        return self.context.Elements

    def GetVisibleElements2D(self):
        self.context2D = VisibleElementContext2D(self._parentDocument)
        exp = CustomExporter(self._parentDocument, self.context2D)
        views = List[ElementId]([self._activeView.Id])
        exp.Export(views)
        return self.context2D.Elements


class VisibleElementContext2D(IExportContext2D):
    def __init__(self, doc):
        self.ParentDocument = doc
        self.CurrentDocument = doc
        self.Documents = [doc]
        self.Elements = []
        self.ElementIds = []
        self.DocMap = {}
        self.DocMap[self.CurrentDocument.Title] = []

    def Finish(self):
        pass

    def IsCanceled(self):
        return False

    def OnCurve(self, node):
        return RenderNodeAction.Skip

    def OnElementBegin(self, elementId):
        return RenderNodeAction.Skip

    def OnElementBegin2D(self, node):
        self.ElementIds.append(node.ElementId)
        elem = self.CurrentDocument.GetElement(node.ElementId)
        self.Elements.append(elem)
        self.DocMap[self.CurrentDocument.Title].append(elem)
        return RenderNodeAction.Proceed

    def OnElementEnd(self, elementId):
        pass

    def OnElementEnd2D(self, node):
        pass

    def OnFaceBegin(self, node):
        return RenderNodeAction.Skip

    def OnFaceEdge2D(self, node):
        return RenderNodeAction.Skip

    def OnFaceEnd(self, node):
        pass

    def OnFaceSilhouette2D(self, node):
        return RenderNodeAction.Skip

    def OnInstanceBegin(self, node):
        return RenderNodeAction.Proceed

    def OnInstanceEnd(self, node):
        pass

    def OnLight(self, node):
        pass

    def OnLineSegment(self, segment):
        pass

    def OnLinkBegin(self, node):
        doc = node.GetDocument()
        self.Documents.append(doc)
        self.CurrentDocument = doc
        if self.CurrentDocument.Title not in self.DocMap:
                self.DocMap[self.CurrentDocument.Title] = []
        return RenderNodeAction.Proceed

    def OnLinkEnd(self, node):
        self.CurrentDocument = self.ParentDocument

    def OnMaterial(self, node):
        raise NotImplementedError

    def OnPolyline(self, node):
        return RenderNodeAction.Skip

    def OnPolylineSegments(self, segments):
        pass

    def OnPolymesh(self, node):
        pass

    def OnRPC(self, node):
        pass

    def OnText(self, node):
        pass

    def OnViewBegin(self, node):
        return RenderNodeAction.Proceed

    def OnViewEnd(self, elementId):
        pass

    def Start(self):
        return True

class VisibleElementContext(IExportContext):
    def __init__(self, doc):
        self.ParentDocument = doc
        self.CurrentDocument = doc
        self.Documents = [doc]
        self.Elements = []
        self.ElementIds = []
        self.DocMap = {}
        self.DocMap[self.CurrentDocument.Title] = []

    def Start(self):
        return True

    def Finish(self):
        pass

    def IsCanceled(self):
        return False

    def OnViewBegin(self, node):
        return RenderNodeAction.Proceed

    def OnViewEnd(self, elementId):
        pass

    def OnElementBegin(self, elementId):
        self.ElementIds.append(elementId)
        elem = self.CurrentDocument.GetElement(elementId)
        self.Elements.append(elem)
        self.DocMap[self.CurrentDocument.Title].append(elem)
        return RenderNodeAction.Proceed

    def OnElementEnd(self, elementId):
        pass

    def OnInstanceBegin(self, node):
        return RenderNodeAction.Proceed

    def OnInstanceEnd(self, node):
        pass

    def OnLinkBegin(self, node):
        doc = node.GetDocument()
        self.Documents.append(doc)
        self.CurrentDocument = doc
        if self.CurrentDocument.Title not in self.DocMap:
                self.DocMap[self.CurrentDocument.Title] = []
        return RenderNodeAction.Proceed

    def OnLinkEnd(self, node):
        self.CurrentDocument = self.ParentDocument

    def OnFaceBegin(self, node):
        return RenderNodeAction.Skip

    def OnFaceEnd(self, node):
        pass

    def OnRPC(self, node):
        pass

    def OnLight(self, node):
        pass

    def OnMaterial(self, node):
        pass

    def OnPolymesh(self, node):
        pass


collector = ElementCollector(uidoc)
listout = None
if doc.ActiveView.ViewType == ViewType.ThreeD:
        elements = collector.GetVisibleElements()
        listout = collector.context.DocMap
else:
        elements = collector.GetVisibleElements2D()
        listout = collector.context2D.DocMap

OUT = listout #elements, [x.GetType() for x in elements if x is not None]
# ----------------------------------------
ꟿ_collect_currentselection = Custom[ꟿ Collect.CurrentSelection]()  # package spring nodes; Gets the currently selected elements. Connect a boolean switch to refresh the selection.
views = Views("00 - C00_Algemeen")
python_script_2 = Python(IN[0]=views)  # IronPython2
# ---------- python_script_2.python (236 lines) ----------
import clr

clr.AddReference("RevitServices")
import RevitServices
from RevitServices.Persistence import DocumentManager
from RevitServices.Transactions import TransactionManager
doc = DocumentManager.Instance.CurrentDBDocument
uidoc = DocumentManager.Instance.CurrentUIApplication.ActiveUIDocument

clr.AddReference("RevitAPI")
import Autodesk
from Autodesk.Revit.DB import *

clr.AddReference("RevitNodes")
import Revit
clr.ImportExtensions(Revit.Elements)
clr.ImportExtensions(Revit.GeometryConversion)

from System.Collections.Generic import List

def remove_duplicates(d):
    for key, objects in d.items():
        seen = {}
        new_objects = []
        for obj in objects:
            if obj == None:
                continue
            if obj.Id not in seen:
                seen[obj.Id] = obj
                new_objects.append(obj)
        d[key] = new_objects

class ElementCollector:
    def __init__(self, uidoc, view):
        self._uiDocument = uidoc
        self._app = uidoc.Application.Application
        self._parentDocument = uidoc.Document
        self._activeView = self._parentDocument.ActiveView
        self._view = view
        
        
    def GetVisibleElements(self):
    	viewtype = self._view.ViewType
    	is2D = False
    	if viewtype == ViewType.ThreeD:
    		self.context = VisibleElementContext(self._parentDocument)
        elif viewtype == ViewType.FloorPlan or viewtype == ViewType.Section or viewtype == ViewType.Elevation or viewtype == ViewType.CeilingPlan or viewtype == ViewType.AreaPlan or viewtype == ViewType.EngineeringPlan:
        	self.context = VisibleElementContext2D(self._parentDocument)
        	is2D = True
        	
        exp = CustomExporter(self._parentDocument, self.context)
        views = List[ElementId]([self._view.Id])
        exp.Export(views)
        
        outmap = self.context.DocMap
        if is2D:
        	#something weird with duplicate elements in the VisibleElementContext2D, so this is a makeshift solution
        	remove_duplicates(outmap)
        		       		
        return outmap
        

        


class VisibleElementContext2D(IExportContext2D):
    def __init__(self, doc):
        self.ParentDocument = doc
        self.CurrentDocument = doc
        self.Documents = [doc]
        self.Elements = []
        self.ElementIds = []
        self.DocMap = {}
        self.DocMap[self.CurrentDocument.Title] = []

    def Finish(self):
        pass

    def IsCanceled(self):
        return False

    def OnCurve(self, node):
        return RenderNodeAction.Skip

    def OnElementBegin(self, elementId):
        return RenderNodeAction.Skip

    def OnElementBegin2D(self, node):
        elem = self.CurrentDocument.GetElement(node.ElementId)
        self.Elements.append(elem)
        self.DocMap[self.CurrentDocument.Title].append(elem)
        return RenderNodeAction.Proceed

    def OnElementEnd(self, elementId):
        pass

    def OnElementEnd2D(self, node):
        pass

    def OnFaceBegin(self, node):
        return RenderNodeAction.Skip

    def OnFaceEdge2D(self, node):
        return RenderNodeAction.Skip

    def OnFaceEnd(self, node):
        pass

    def OnFaceSilhouette2D(self, node):
        return RenderNodeAction.Skip

    def OnInstanceBegin(self, node):
        return RenderNodeAction.Proceed

    def OnInstanceEnd(self, node):
        pass

    def OnLight(self, node):
        pass

    def OnLineSegment(self, segment):
        pass

    def OnLinkBegin(self, node):
        doc = node.GetDocument()
        self.Documents.append(doc)
        self.CurrentDocument = doc
        if self.CurrentDocument.Title not in self.DocMap:
        	self.DocMap[self.CurrentDocument.Title] = []
        return RenderNodeAction.Proceed

    def OnLinkEnd(self, node):
        self.CurrentDocument = self.ParentDocument

    def OnMaterial(self, node):
        pass

    def OnPolyline(self, node):
        return RenderNodeAction.Skip

    def OnPolylineSegments(self, segments):
        pass

    def OnPolymesh(self, node):
        pass

    def OnRPC(self, node):
        pass

    def OnText(self, node):
        pass

    def OnViewBegin(self, node):
        return RenderNodeAction.Proceed

    def OnViewEnd(self, elementId):
        pass

    def Start(self):
        return True
        
class VisibleElementContext(IExportContext):
    def __init__(self, doc):
        self.ParentDocument = doc
        self.CurrentDocument = doc
        self.Documents = [doc]
        self.Elements = []
        self.ElementIds = []
        self.DocMap = {}
        self.DocMap[self.CurrentDocument.Title] = []

    def Start(self):
        return True

    def Finish(self):
        pass

    def IsCanceled(self):
        return False

    def OnViewBegin(self, node):
        return RenderNodeAction.Proceed

    def OnViewEnd(self, elementId):
        pass

    def OnElementBegin(self, elementId):
        self.ElementIds.append(elementId)
        elem = self.CurrentDocument.GetElement(elementId)
        self.Elements.append(elem)
        self.DocMap[self.CurrentDocument.Title].append(elem)
        return RenderNodeAction.Proceed

    def OnElementEnd(self, elementId):
        pass

    def OnInstanceBegin(self, node):
        return RenderNodeAction.Proceed

    def OnInstanceEnd(self, node):
        pass

    def OnLinkBegin(self, node):
        doc = node.GetDocument()
        self.Documents.append(doc)
        self.CurrentDocument = doc
        if self.CurrentDocument.Title not in self.DocMap:
        	self.DocMap[self.CurrentDocument.Title] = []
        return RenderNodeAction.Proceed

    def OnLinkEnd(self, node):
        self.CurrentDocument = self.ParentDocument

    def OnFaceBegin(self, node):
        return RenderNodeAction.Skip

    def OnFaceEnd(self, node):
        pass

    def OnRPC(self, node):
        pass

    def OnLight(self, node):
        pass

    def OnMaterial(self, node):
        pass

    def OnPolymesh(self, node):
        pass

view = UnwrapElement(IN[0])
collector = ElementCollector(uidoc, view)
elements = collector.GetVisibleElements()

OUT = elements
# ----------------------------------------
code_block_2 = CodeBlock(x=python_script_2) { x[0][0]; }
values = DesignScript.Builtin.Dictionary.Values(dictionary=python_script_2)
components = DesignScript.Builtin.Dictionary.Components(dictionary=python_script_2)
code_block_3 = CodeBlock(x=components.values) { x[0]; }
uniqueItems_2 = List.UniqueItems(list=code_block_3)
