# Dynamo graph IFC export.dyn (Dynamo 2.12.1.8246)
# packages: spring nodes 210.1.1

directory_path = Directory("C:\Users\taco\OneDrive - MEPover\Werk\BUCC\ASML")
ꟿ_document_activeview = Custom[ꟿ Document.ActiveView]()  # package spring nodes; Selects the current document's active view. Supports more view types than the built-in option. Will be depreciated once the bult in node works with all plan types.
string_from_object = FromObject(obj=ꟿ_document_activeview)
code_block = CodeBlock { " = "; }
split = String.Split(string=string_from_object, separator0=code_block)
code_block_2 = CodeBlock { 1; }
getItemAtIndex = List.GetItemAtIndex(list=split@L2, index=code_block_2)
length = String.Length(string=getItemAtIndex)
code_block_3 = CodeBlock(x=length) { x-2; }
code_block_4 = CodeBlock { 2; }
remove = String.Remove(string=getItemAtIndex, startIndex=code_block_3, count=code_block_4)
code_block_5 = CodeBlock(x=directory_path, y=remove) { x+"\\"+y; }
folder_filename_and_ifc_version = CodeBlock()
# ---------- folder_filename_and_ifc_version.designscript (8 lines) ----------
//IFC Version
"IFC2x2";
"IFC2x3";
"IFC2x3CV2";
"IFC2x2";
"IFC4";
"IFCBCA";
"IFCCOBIE";
# ----------------------------------------
boolean = BoolSelector(false)  # graph input
boolean_2 = BoolSelector(true)  # graph input
code_block_6 = CodeBlock()
# ---------- code_block_6.designscript (4 lines) ----------
// project origin
shared_coordinates = 0;
survey_point = 1;
project_base_point = 2;
# ----------------------------------------
python_script = Python(IN[0]=directory_path, IN[1]=code_block_5, IN[2]=folder_filename_and_ifc_version.out1, IN[3]=boolean, IN[4]=boolean_2, IN[5]=ꟿ_document_activeview, IN[6]=code_block_6.shared_coordinates)  # IronPython2
# ---------- python_script.python (113 lines) ----------
#python nodes in dynamo 0.7
#proposed by Nicklas Verdier Østergaard, nvo@niras.dk
#Based on tools.dwf by Julien Benoit @jbenoit44
#http://aecuandme.wordpress.com/
import clr
clr.AddReference('ProtoGeometry')
from Autodesk.DesignScript.Geometry import *
# Import ToDSType(bool) extension method
clr.AddReference("RevitNodes")
import Revit
clr.ImportExtensions(Revit.Elements)
# Import geometry conversion extension methods
clr.ImportExtensions(Revit.GeometryConversion)
# Import DocumentManager and TransactionManager
clr.AddReference("RevitServices")
import RevitServices
from RevitServices.Persistence import DocumentManager
from RevitServices.Transactions import TransactionManager
from System.Collections.Generic import *
# Import RevitAPI
clr.AddReference("RevitAPI")
import Autodesk
from Autodesk.Revit.DB import *

import System

doc = DocumentManager.Instance.CurrentDBDocument
uiapp = DocumentManager.Instance.CurrentUIApplication
app = uiapp.Application
uidoc=DocumentManager.Instance.CurrentUIApplication.ActiveUIDocument

#The inputs to this node will be stored as a list in the IN variable.
#dataEnteringNode = IN

folder=UnwrapElement(IN[0])
fileversion = IN[2]
wallandcolumnsplitting = IN[3]
exportbasequantities = IN[4]
if isinstance(IN[5], list):
	view = UnwrapElement(IN[5])
	name=UnwrapElement(IN[1])
else:
	view = [UnwrapElement(IN[5])]
	name= [UnwrapElement(IN[1])]
name = IN[1][0]
origin = IN[6].ToString()

#IFCVersion=UnwrapElement(IN[2])

# Start Transaction
TransactionManager.Instance.EnsureInTransaction(doc)
total_export = []

#for i,v in enumerate(view):
options=IFCExportOptions()

#if fileversion != None:
#	options.FileVersion = fileversion
if fileversion == "IFC4":
	options.FileVersion = IFCVersion.IFC4
if fileversion == "IFC2x2":
	options.FileVersion = IFCVersion.IFC2x2
if fileversion == "IFC2x3":
	options.FileVersion = IFCVersion.IFC2x3
if fileversion == "IFC2x3":
	options.FileVersion = IFCVersion.IFC2x3CV2
if fileversion == "IFCBCA":
	options.FileVersion = IFCVersion.IFCBCA
if fileversion == "IFCCOBIE":
	options.FileVersion = IFCVersion.IFCCOBIE
if fileversion == "":
	options.FileVersion = IFCVersion.Default
	
	
#options.WallAndColumnSplitting = wallandcolumnsplitting
options.ExportBaseQuantities = exportbasequantities
options.FilterViewId = view[0].Id
#options.AddOption("ExportAnnotations","true");
#options.AddOption("SpaceBoundaries", "2");
#options.AddOption("VisibleElementsOfCurrentView", "true");
#options.AddOption("Use2DRoomBoundaryForVolume", "false");
#options.AddOption("UseFamilyAndTypeNameForReference", "false");
#options.AddOption("ExportInternalRevitPropertySets","true");
#options.AddOption("ExportIFCCommonPropertySets","true");
#options.AddOption("Export2DElements", "true");
#options.AddOption("ExportPartsAsBuildingElements", "false");
#options.AddOption("ExportBoundingBox", "false");
#options.AddOption("ExportSolidModelRep", "true");
#options.AddOption("ExportSchedulesAsPsets", "false");
#options.AddOption("ExportLinkedFiles", "false");
#options.AddOption("IncludeSiteElevation","true");
#options.AddOption("UseActiveViewGeometry", "true");
#options.AddOption("ExportSpecificSchedules", "false");
#options.AddOption("TessellationLevelOfDetail", "0.5");
#options.AddOption("StoreIFCGUID", "true");
#options.AddOption("ExportRoomsInView", "false");
#options.AddOption("SitePlacement",origin);


#IFCVersion Version = (IFCVersion) Enum.Parse( typeof(IFCVersion), UnwrapElement(IN[2]), true );
#x.FileVersion = IFCVersion.IFC2x3CV2

c=doc.Export.Overloads[System.String,System.String,IFCExportOptions](folder,"", options)
#total_export.append(c)

# End Transaction
TransactionManager.Instance.TransactionTaskDone()

OUT = c
#if fileversion == "":
#	OUT="Default settings used"
#else:
#	OUT=total_export
# ----------------------------------------
watch = Watch(python_script)
code_block_7 = CodeBlock { 1; }
dropItems = List.DropItems(list=ꟿ_document_activeview, amount=code_block_7)
