# Dynamo graph Material set name.dyn (Dynamo 2.12.1.8246)

categories = Categories("OST_Materials")
all_elements_of_category = ElementsOfCategory(Category=categories)
code_block = CodeBlock { "Name"; }
getParameterValueByName = Element.GetParameterValueByName(element=all_elements_of_category, parameterName=code_block)
code_block_2 = CodeBlock(x=getParameterValueByName) { x+"_test"; }
python_script = Python(IN[0]=all_elements_of_category, IN[1]=code_block_2)  # IronPython2
# ---------- python_script.python (44 lines) ----------
import clr

clr.AddReference("RevitServices")
import RevitServices
from RevitServices.Persistence import DocumentManager
from RevitServices.Transactions import TransactionManager
doc = DocumentManager.Instance.CurrentDBDocument
uidoc = DocumentManager.Instance.CurrentUIApplication.ActiveUIDocument

clr.AddReference("RevitAPI")
import Autodesk
from Autodesk.Revit.DB import *

clr.AddReference("RevitNodes")
import Revit
clr.ImportExtensions(Revit.Elements)
clr.ImportExtensions(Revit.GeometryConversion)

from System.Collections.Generic import List

materials = UnwrapElement(IN[0])
names = IN[1]

if isinstance(IN[0], list):
	materials = UnwrapElement(IN[0])
else:
	materials = [UnwrapElement(IN[0])]
	
if isinstance(IN[1], list):
	names = IN[1]
else:
	names = [IN[1]]

listout = []

TransactionManager.Instance.EnsureInTransaction(doc)
for mat,name in zip(materials,names):
	mat.Name = name
	listout.append(mat)
	
TransactionManager.Instance.TransactionTaskDone()


OUT = listout
# ----------------------------------------
