# Dynamo graph Parse XML navisworks report.dyn (Dynamo 2.14.0.4641)
# packages: Clockwork for Dynamo 1.x 1.34.0

file_path = Filename("C:\Users\taco\OneDrive - MEPover\Werk\BUCC\ASML\10C\Beugels - INS.xml")
code_block = CodeBlock { "_HOM_"; }
python_script = Python(IN[0]=file_path, IN[1]=code_block)  # CPython3
# ---------- python_script.python (41 lines) ----------
# Load the Python Standard and DesignScript Libraries
import sys
import clr
clr.AddReference('ProtoGeometry')
from Autodesk.DesignScript.Geometry import *

# The inputs to this node will be stored as a list in the IN variables.
dataEnteringNode = IN
party = IN[1]

import xml.etree.ElementTree as ET

def get_smarttag_values(xml_file):
    tree = ET.parse(xml_file)
    root = tree.getroot()
    smarttag_values = []

    for clashresult in root.findall(".//clashresult"):
        for clashobject in clashresult.findall(".//clashobject"):
            pathlink = clashobject.find(".//pathlink")
            if pathlink is not None:
                nodes = [node.text for node in pathlink.findall(".//node")]
                if any(party in node for node in nodes):
                    smarttags = clashobject.findall(".//smarttag")
                    for smarttag in smarttags:
                        name = smarttag.find("name")
                        value = smarttag.find("value")
                        if name is not None and name.text == "Element IfcTag" and value is not None:
                            smarttag_values.append(value.text)
    
    return smarttag_values

# Example usage
xml_file = IN[0]
smarttag_values = get_smarttag_values(xml_file)

listout = ";".join(smarttag_values)
# Place your code below this line

# Assign your output to the OUT variable.
OUT = listout
# ----------------------------------------
sendTo = Custom[Clipboard.SendTo](str=python_script)  # package Clockwork for Dynamo 1.x; Copies a string to the clipboard.
