# Dynamo graph View filter add to all view templates.dyn (Dynamo 2.6.1.8786)

python_script_all_viewtemplates = Python()  # unwired: IN[0]
# ---------- python_script_all_viewtemplates.python (20 lines) ----------
import clr
clr.AddReference('RevitAPI')
from Autodesk.Revit.DB import *
import Autodesk

clr.AddReference("RevitServices")
import RevitServices
from RevitServices.Persistence import DocumentManager

doc = DocumentManager.Instance.CurrentDBDocument


collector = FilteredElementCollector(doc)
views = collector.OfClass(View).ToElements()
viewlist = list()
names = []
for view in views:
	if view.IsTemplate:
		viewlist.append(view)
OUT = viewlist
# ----------------------------------------
isNull = Object.IsNull(obj=python_script_all_viewtemplates)
filterByBoolMask = List.FilterByBoolMask(list=python_script_all_viewtemplates, mask=isNull)
element_types = ElementTypes("ParameterFilterElement")
all_elements_of_type = ElementsOfType(element_type=element_types)
code_block = CodeBlock(x=all_elements_of_type) { x.Name; }
filter_name = CodeBlock { "section"; }
code_block_2 = CodeBlock { 1; }
contains = String.Contains(str=code_block, searchFor=filter_name, ignoreCase=code_block_2)
filterByBoolMask_2 = List.FilterByBoolMask(list=all_elements_of_type, mask=contains)
addFilter = View.AddFilter(view=filterByBoolMask.out, parameterFilter=filterByBoolMask_2.in, lacing=CrossProduct)
